# Grasshopper definition 01-00-bis_gradient descent - intuition.gh (Grasshopper 1.0.7)
# plug-ins: Anemone, Weaverbird

mesh = Mesh(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)
facen = FaceNormals(Mesh=mesh)  # -> Centers, Normals
# <title>
# 
# <description>
# 
# code by Alessio Erioli
# 
# v 0.1
number_slider = Slider(150, range=0..200)
pt = Point(simplify(graft(facen.Centers)))
cloud = CloudDisplay(Points=flatten(pt), Colours=ColourSwatch(SwatchColor=RGB(255, 255, 255)), Size="0.5", SpriteType=0)
loop_start = LoopStart(Repeat=number_slider, Trigger=Button(), Data=pt)  # -> port, Counter, Data; disabled
item = ListItem(List=loop_start.Data, Index="-1", Wrap=True)
Z = UnitZ(Factor=Slider(-1, range=-1..0))
wbcatmullclark = WeaverbirdsCatmullClarkSubdivision(MeshCurves=mesh, Level=1, SmoothNakedEdges=2)
move = Move(Geometry=item, Motion=Z)  # -> Geometry, Transform
meshcp = MeshClosestPoint(Point=move.Geometry, Mesh=wbcatmullclark)  # -> Point, Index, Parameter
merge = Merge(Data1=loop_start.Data, Data2=simplify(meshcp.Point))
loop_end = LoopEnd(port=loop_start.port, Exit=False, Data=simplify(merge), TimeOutVal=0, pausedState=False, state="Constant output")
pline = PolyLine(Vertices=loop_end, Closed=False)
preview = CustomPreview(Geometry=pline, Shader=ColourSwatch(SwatchColor=RGB(255, 255, 255)))
