# Grasshopper definition 01-01_environment and field - intuition.gh (Grasshopper 1.0.7)
# Copyright: Co-de-iT
# plug-ins: Anemone, Noise 4D

number_slider = Slider(200, range=2..1000)
seed = Slider(10, range=1..100)

# ---- group: field parameters
number_slider_2 = Slider(0, range=0..1)
number_slider_3 = Slider(0.05, range=0..0.2)
max_angle = Slider(1, range=0..5)
field_strength = Slider(0.1, range=0..10)

# ----
start = Button()
# moving in a field (noise)
number_slider_4 = Slider(153, range=0..300)
rectangle = Rectangle(Plane=PlaneXY(0, 0, 0), XSize="-5 to 5", YSize="-5 to 5", Radius=0)  # -> Rectangle, Length
noise_type = ValueList({"Perlin": 0, "Curl": 1}, selected="Perlin")
pop2d = Populate2D(Region=rectangle.Rectangle, Count=number_slider, Seed=1)  # -> simplify(graft(Population))
random_vectors = CSharpScript(n=number_slider, S=seed)  # -> out, simplify(graft(V)); inputs n: Int32, S: Int32
# ---------- random_vectors: C# ----------
    if (n <= 0 || S < 0) return;

    List <Vector3d> vecs = new List<Vector3d>();
    Vector3d v;
    rnd = new Random(S);

    for (int i = 0; i < n; i++)
    {
      v = new Vector3d(1, 0, 0);
      v.Rotate(rnd.NextDouble() * Math.PI * 2, Vector3d.ZAxis);
      vecs.Add(v);
    }

    V = vecs;
# ---------- random_vectors: C# additional code ----------
  Random rnd;
# ---------- end random_vectors ----------
loop_start = LoopStart(N=number_slider_4, T=start, D0=pop2d, D1=random_vectors.V)  # -> port, Counter, Data, Data_2; disabled
vdisex = VectorDisplayEx(Point=pop2d, Vector=random_vectors.V, Colour=RGB(0, 0, 0), Width=2)
# <title>
# 
# <description>
# 
# code by Alessio Erioli
# 
# v 0.1
panel = Panel(loop_start.Counter)
item = ListItem(List=loop_start.Data, Index="-1", Wrap=True)
item_2 = ListItem(List=loop_start.Data_2, Index="-1", Wrap=True)

# ---- group: Curl Noise
# ** requires Noises.dll **
# 
# Right click > Manage Assemblies
# 
# Add Noises.dll to the window of referenced assemblies
_3d = BooleanToggle(False)
c_script = CSharpScript(
    P=item,
    t=number_slider_2,
    S=number_slider_3,
    is3D=_3d,
    Reference="C:\Users\Alessio\AppData\Roaming\Grasshopper\Libraries\Noises.dll")  # -> out, C; inputs P: Point3d, t: Double, S: Double, is3D: Boolean
# ---------- c_script: C# usings ----------
using Noises;
# ---------- c_script: C# ----------
    C = CurlNoise.CurlNoiseVector(P, S, t, is3D);
# ---------- end c_script ----------

# ----
max_speed = Slider(1, range=0..2)

# ----
# preview noise field
number_slider_5 = Slider(50, range=0..100)
cell_size = Slider(0.5, range=0..2)
number_slider_6 = Slider(25, range=0..100)
c_script_2 = CSharpScript(n=number_slider_5)  # -> D; inputs n: Double
# ---------- c_script_2: C# ----------
    D = new Interval(-n, n);
# ---------- end c_script_2 ----------
c_script_3 = CSharpScript(n=number_slider_6)  # -> D; inputs n: Double; same code as c_script_2
division = Division(A=number_slider_5, B=cell_size)
division_2 = Division(A=number_slider_6, B=cell_size)
rectangle_2 = Rectangle(Plane=PlaneXY(0, 0, 0), XSize=c_script_2, YSize=c_script_3, Radius=0)  # -> Rectangle, Length
int = Integer(division)
int_2 = Integer(division_2)
sdivide = DivideSurface(Surface=rectangle_2.Rectangle, UCount=int, VCount=int_2)  # -> Points, Normals, Parameters
perlin = PerlinNoise(Values=sdivide.Points, Time=number_slider_2, Scale=number_slider_3)
expression = Expression(x=perlin, y=max_angle, Expression="x*y*π")
X = UnitX(Factor=1)
Z = UnitZ(Factor=1)
vrot = Rotate(Vector=X, Axis=Z, Angle=expression)
swatch = ColourSwatch(SwatchColor=RGB(20, 20, 20))
crv = Curve(rectangle_2.Rectangle)

# ---- group: Curl Noise
# ** requires Noises.dll **
# 
# Right click > Manage Assemblies
# 
# Add Noises.dll to the window of referenced assemblies
_3d_2 = BooleanToggle(False)
c_script_4 = CSharpScript(
    P=sdivide.Points,
    t=number_slider_2,
    S=number_slider_3,
    is3D=_3d_2,
    Reference="C:\Users\Alessio\AppData\Roaming\Grasshopper\Libraries\Noises.dll")  # -> out, C; inputs P: Point3d, t: Double, S: Double, is3D: Boolean; same code as c_script

# ---- group: calculate field acceleration vector
perlin_2 = PerlinNoise(Values=item, Time=number_slider_2, Scale=number_slider_3)
expression_2 = Expression(x=perlin_2, y=max_angle, Expression="x*y*π")
X_2 = UnitX(Factor=1)
Z_2 = UnitZ(Factor=1)
vrot_2 = Rotate(Vector=X_2, Axis=Z_2, Angle=expression_2)

# ----
filter = StreamFilter(Gate=noise_type, Stream0=vrot_2, Stream1=c_script.C)

# ---- group: calculate field acceleration vector (continued)
amp = Amplitude(Vector=filter, Amplitude=field_strength)

# ---- group: add to speed
addition = Addition(A=item_2, B=amp)

# ----
vlen = VectorLength(Vector=addition)
min = Minimum(A=vlen, B=max_speed)

# ---- group: limit speed
amp_2 = Amplitude(Vector=addition, Amplitude=min)

# ---- group: move point
move = Move(Geometry=item, Motion=amp_2)  # -> Geometry, Transform

# ----
merge = Merge(Data1=loop_start.Data, Data2=simplify(move.Geometry))
merge_2 = Merge(Data1=loop_start.Data_2, Data2=simplify(amp_2))

# ---- group: display current velocity
vdisex_2 = VectorDisplayEx(Point=move.Geometry, Vector=amp_2, Colour=ColourSwatch(SwatchColor=RGB(255, 255, 255)), Width=2)

# ----
filter_2 = StreamFilter(Gate=noise_type, Stream0=vrot, Stream1=c_script_4.C)
amp_3 = Amplitude(Vector=filter_2, Amplitude=Slider(1.5, range=0..5))

unit = UnitVector(Vector=filter_2)

vdisex_3 = VectorDisplayEx(Point=sdivide.Points, Vector=amp_3, Colour=unit, Width=1)

# ---- group: limit trail length
trail_length = Slider(20, range=1..50)
larger = LargerThan(FirstNumber=loop_start.Counter, SecondNumber=expr("x-1", trail_length))  # -> LargerThan, OrEqualTo
range = Range(Domain=Domain(0, 1), Steps=expr("x-1", trail_length))

# ----
and = GateAnd(B=larger.OrEqualTo)

# ---- group: limit trail length (continued)
shift = ShiftList(List=merge, Shift=and, Wrap="false")
shift_2 = ShiftList(List=merge_2, Shift=and, Wrap="false")

# ----
loop_end = LoopEnd(
    port=loop_start.port,
    Exit=False,
    Data=simplify(shift),
    Data_2=simplify(shift_2),
    TimeOutVal=0,
    pausedState=False,
    state="Constant output")  # -> D0, D1
gradient = Gradient(LowerLimit=0, UpperLimit=1, Parameter=range, stops=[0: RGBA(0, 0, 0, 0), 1: RGB(255, 255, 255)])
pt = Point(loop_end.D0)
vec = Vector(loop_end.D1)
vdisex_4 = VectorDisplayEx(Point=pt, Vector=vec, Colour=gradient, Width=1)
