# Grasshopper definition 01-05_fields on mesh.gh (Grasshopper 1.0.7)
# plug-ins: Anemone, Noise 4D

mesh = Mesh(<mesh referenced from the Rhino model>)
pt = Point(Point(0, 0, 144.4028772))
number_slider = Slider(5.355, range=0..30)
facen = FaceNormals(Mesh=mesh)  # -> Centers, Normals
msphere = MeshSphere(Base=pt, Radius=Slider(30, range=0..200), UCount=10, VCount=20)
msphere_2 = MeshSphere(Base=pt, Radius=number_slider, UCount=10, VCount=20)
minc = MeshInclusion(Mesh=msphere, Point=facen.Centers, Strict=False)
minc_2 = MeshInclusion(Mesh=msphere_2, Point=facen.Centers, Strict=False)
not = GateNot(A=minc)
cull = CullPattern(List=facen.Centers, CullPattern=minc_2)
cullf = CullFaces(Mesh=mesh, Pattern=not)
# <title>
# 
# <description>
# 
# code by Alessio Erioli
# 
# v 0.1
panel = Panel("1000")
cir = Circle(Plane=pt, Radius=number_slider)
mesh_2 = Mesh(cullf)
divide = DivideCurve(Curve=cir, Count=Slider(50, range=10..100), Kinks=False)  # -> Points, Tangents, Parameters
reduce = RandomReduce(List=cull, Reduction=panel, Seed=1)

# ---- group: charge planes
demesh = DeconstructMesh(Mesh=mesh_2)  # -> Vertices, Faces, Colours, Normals
reduction_factor = Slider(0.99, range=0..1)
c_script = CSharpScript(D=demesh.Vertices)  # -> i; inputs D: list
# ---------- c_script: C# usings ----------
using System.Linq;
# ---------- c_script: C# ----------
    int[] indexes = new int[D.Count];
    for(int j = 0; j < D.Count; j++)
      indexes[j] = j;
    
    i = indexes;
# ---------- end c_script ----------
lng = ListLength(List=demesh.Vertices)
multiplication = Multiplication(A=lng, B=reduction_factor)
reduce_2 = RandomReduce(List=c_script, Reduction=multiplication, Seed=1)
item = ListItem(List=demesh.Vertices, Index=reduce_2, Wrap=True)
item_2 = ListItem(List=demesh.Normals, Index=reduce_2, Wrap=True)
pl = PlaneNormal(Origin=item, ZAxis=item_2)

# ----
number_slider_2 = Slider(0.03, range=0..1)
number_slider_3 = Slider(2.027, range=0..10)
meshcp = MeshClosestPoint(Point=reduce, Mesh=mesh_2)  # -> graft(Point), Index, Parameter

# ---- group: display simplex noise on mesh
simplex = SimplexNoise(Values=demesh.Vertices, Time=number_slider_3, Scale=number_slider_2)
gradient = Gradient(LowerLimit="-1", UpperLimit=1, Parameter=simplex, stops=[0: RGB(0, 0, 0), 1: RGB(255, 255, 255)])
conmesh = ConstructMesh(Vertices=demesh.Vertices, Faces=demesh.Faces, Colours=gradient)

# ---- group: modulate charge radius with simplex noise
simplex_2 = SimplexNoise(Values=item, Time=number_slider_3, Scale=number_slider_2)
num = Number(simplex_2)
bnd = Bounds(Numbers=flatten(num))
dom = ConstructDomain(DomainStart=Slider(3.5, range=0..30), DomainEnd=Slider(0.498, range=0..30))
remap = RemapNumbers(Value=num, Source=bnd, Target=dom)  # -> Mapped, Clipped

# ----
number_slider_4 = Slider(21, range=0..100)

# ---- group: generate field
fspin = SpinForce(Plane=pl, Strength=Slider(1, range=0..20), Radius=remap.Mapped, Decay=2)
mergef = MergeFields(Fields=fspin)

# ----
loop_start = LoopStart(Repeat=number_slider_4, Trigger=Button(), Data=simplify(meshcp.Point))  # -> port, Counter, Data; disabled
equals = Equality(FirstNumber=number_slider_4, SecondNumber=loop_start.Counter)  # -> Equality, Inequality
item_3 = ListItem(List=loop_start.Data, Index="-1", Wrap=True)
evf = EvaluateField(Field=mergef, Point=item_3)  # -> simplify(Tensor), Strength

# ---- group: display the field on the mesh
evf_2 = EvaluateField(Field=mergef, Point=demesh.Vertices)  # -> Tensor, Strength
dom_2 = ConstructDomain(DomainStart=Slider(0.345, range=0..5), DomainEnd=Slider(1, range=0..5))
bnd_2 = Bounds(Numbers=evf_2.Strength)
remap_2 = RemapNumbers(Value=evf_2.Strength, Source=bnd_2, Target=dom_2)  # -> Mapped, Clipped
amp = Amplitude(Vector=evf_2.Tensor, Amplitude=remap_2.Mapped)
vdisex = VectorDisplayEx(Point=demesh.Vertices, Vector=amp, Colour=RGB(0, 0, 0), Width=1)  # disabled

# ----
amp_2 = Amplitude(Vector=evf.Tensor, Amplitude=Slider(0.2, range=0..1))
move = Move(Geometry=item_3, Motion=amp_2)  # -> Geometry, Transform
meshcp_2 = MeshClosestPoint(Point=move.Geometry, Mesh=mesh_2)  # -> Point, Index, Parameter
merge = Merge(Data1=loop_start.Data, Data2=meshcp_2.Point)
loop_end = LoopEnd(port=loop_start.port, Exit=False, Data=simplify(merge), TimeOutVal=0, pausedState=False, state="Constant output")
gate = StreamGate(Stream=loop_end, Gate=equals.Equality)  # -> Target0, flatten(Target1)
pline = PolyLine(Vertices=gate.Target0, Closed=False)
cloud = CloudDisplay(Points=gate.Target1, Colours="black", Size="0.1", SpriteType=0)
