# Grasshopper definition day 01_class 01.gh (Grasshopper 1.0.7)
# Copyright: Co-de-iT
# plug-ins: Anemone

number_slider = Slider(100, range=0..100)
X = UnitX(Factor=1)
pt = Point(Point(0, 0, 0))
loop_start = LoopStart(N=number_slider, T=Button(), D0=pt, D1=X)  # -> port, Counter, Data, Data_2
X_2 = UnitX(Factor="10")
X_3 = UnitX(Factor=1)
panel = Panel(loop_start.Counter)
move = Move(Geometry=pt, Motion=X_3)  # -> Geometry, Transform
# <title>
# 
# <description>
# 
# code by Alessio Erioli
# 
# v 0.1
move_2 = Move(Geometry=pt, Motion=X_2)  # -> Geometry, Transform
X_4 = UnitX(Factor=1)
item = ListItem(List=loop_start.Data, Index="-1", Wrap=True)
multiplication = Multiplication(A=loop_start.Counter, B=Slider(67.984, range=1..100))
move_3 = Move(Geometry=move.Geometry, Motion=X_4)  # -> Geometry, Transform
panel_2 = Panel(multiplication)
crv = Curve(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)
crv_2 = Curve(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)

# ---- group: calculate new velocity
division = Division(A=loop_start.Counter, B=number_slider)
panel_3 = Panel(division)
graph = GraphMapper(division, x0=0, x1=1, y0=0, y1=1, container_name="Sine", Equation_px=[0, 0.08902640641], Equation_py=[0, 1])
item_2 = ListItem(List=loop_start.Data_2, Index="-1", Wrap=True)
Z = UnitZ(Factor=1)
vrot = Rotate(Vector=item_2, Axis=Z, Angle=multiplication)

# ----
multiplication_2 = Multiplication(A=division, B=Slider(4.3, range=0..5))
pi = Pi(Factor=multiplication_2)
sin = Sine(Value=pi)

# ---- group: calculate new velocity (continued)
multiplication_3 = Multiplication(A=sin, B=Slider(1, range=0..1))

# ----
addition = Addition(A=item_2, B=vrot)
unit = UnitVector(Vector=addition)
move_4 = Move(Geometry=item, Motion=unit)  # -> Geometry, Transform
merge = Merge(Data1=loop_start.Data, Data2=flatten(move_4.Geometry))
merge_2 = Merge(Data1=loop_start.Data_2, Data2=flatten(unit))
loop_end = LoopEnd(
    port=loop_start.port,
    Exit=False,
    Data=simplify(merge),
    Data_2=simplify(merge_2),
    TimeOutVal=0,
    pausedState=False,
    state="Constant output")  # -> D0, D1
vdisex = VectorDisplayEx(Point=loop_end.D0, Vector=loop_end.D1, Colour=RGB(0, 0, 0), Width=2)
pline = PolyLine(Vertices=loop_end.D0, Closed=False)
