# Grasshopper definition day 01_class 02.gh (Grasshopper 1.0.7)
# Copyright: Co-de-iT
# plug-ins: Anemone, Noise 4D

panel = Panel("https://tinyurl.com/TALM-day01")
paul_bourke_pages_computational_geometry = Panel("http://paulbourke.net")  # "Paul Bourke pages - computational geometry methods"
number_slider = Slider(50, range=2..100)
X = UnitX(Factor=1)
pt = Point(Point(0, 0, 0))
number_slider_2 = Slider(76, range=0..100)
rectangle = Rectangle(Plane=PlaneXY(0, 0, 0), XSize="-5 to 5", YSize="-5 to 5", Radius=0)  # -> Rectangle, Length
rectangle_2 = Rectangle(Plane=PlaneXY(0, 0, 0), XSize="-1 to 1", YSize="-1 to 1", Radius=0)  # -> Rectangle, Length
number_slider_3 = Slider(100, range=2..100)
vdisex = VectorDisplayEx(Point=pt, Vector=X, Colour=RGB(0, 0, 0), Width=2)
rectangle_3 = Rectangle(Plane=PlaneXY(0, 0, 0), XSize="-5 to 5", YSize="-5 to 5", Radius=0)  # -> Rectangle, Length
rectangle_4 = Rectangle(Plane=PlaneXY(0, 0, 0), XSize="-1 to 1", YSize="-1 to 1", Radius=0)  # -> Rectangle, Length
pop2d = Populate2D(Region=rectangle_2.Rectangle, Count=number_slider, Seed=Slider(9, range=0..100))
pop2d_2 = Populate2D(Region=rectangle.Rectangle, Count=number_slider, Seed=1)  # -> simplify(graft(Population))
number_slider_4 = Slider(0.463, range=0..1.571)
# <title>
# 
# <description>
# 
# code by Alessio Erioli
# 
# v 0.1
loop_start = LoopStart(N=number_slider_2, T=Button(), D0=pt, D1=X)  # -> port, Counter, Data, Data_2; disabled
X_2 = UnitX(Factor=1)
vec = Vector(pop2d)
pt_2 = Point(Point(0, 0, 0))
pop2d_3 = Populate2D(Region=rectangle_4.Rectangle, Count=number_slider_3, Seed=Slider(9, range=0..100))
random = Random(Range="-1 to 1", Number=number_slider_2, Seed=Slider(0, range=0..100))
pop2d_4 = Populate2D(Region=rectangle_3.Rectangle, Count=number_slider_3, Seed=1)  # -> simplify(graft(Population))
unit = UnitVector(Vector=vec)  # -> simplify(graft(Vector))

# ---- group: position
item = ListItem(List=loop_start.Data, Index="-1", Wrap=True)

# ---- group: velocity
item_2 = ListItem(List=loop_start.Data_2, Index="-1", Wrap=True)

# ----
vec_2 = Vector(pop2d_3)
number_slider_5 = Slider(100, range=0..1000)
deg = Degrees(Radians=number_slider_4)
item_3 = ListItem(List=random, Index=loop_start.Counter, Wrap=True)
random_2 = Random(Range="0 to 1000", Number=number_slider_3, Seed=2, Integers=True)  # -> simplify(graft(Random))
unit_2 = UnitVector(Vector=vec_2)  # -> simplify(graft(Vector))
number_slider_6 = Slider(0, range=0..100)
wheel = ColourWheel(
    number_slider,
    ColourGrips_Style=10,
    ColourGrips_Grip=[3.828006491, 2.094395102, 4.188790205, 3.141592654],
    ColourGrips_Lum=[0.1, 0.5059534601],
    ColourGrips_Range=[0.2508165892, 0.2508165892, 0.2508165892, 0.2508165892],
    ColourGrips_Sat=[0.2, 0.9098553684])
panel_2 = Panel(deg)
multiplication = Multiplication(A=item_3, B=number_slider_4)
pl = ConstructPlane(Origin=pop2d_2, XAxis=unit, YAxis=Vector(0, 1, 0))
polygon = Polygon(Plane=pl, Radius=Slider(0.732, range=0..3), Segments="3", FilletRadius=0)  # -> Polygon, Length
Z = UnitZ(Factor=1)
vdisex_2 = VectorDisplayEx(Point=pop2d_2, Vector=unit, Colour=RGB(0, 0, 0), Width=2)
vdisex_3 = VectorDisplayEx(Point=pop2d_4, Vector=unit_2, Colour=RGB(0, 0, 0), Width=2)
number_slider_7 = Slider(1.413, range=0..1.571)
scale_nu = ScaleNU(Geometry=polygon.Polygon, Plane=pl, ScaleX=1, ScaleY="0.5", ScaleZ=1)  # -> Geometry, Transform
vrot = Rotate(Vector=item_2, Axis=Z, Angle=multiplication)
loop_start_2 = LoopStart(N=number_slider_5, T=Button(), D0=pop2d_4, D1=unit_2)  # -> port, Counter, Data, Data_2; disabled
panel_3 = Panel(random)
random_3 = Random(Range="-1 to 1", Number=expr("x+1", number_slider_5), Seed=random_2)
addition = Addition(A=item_2, B=vrot)
col = Colour(graft(wheel))
panel_4 = Panel(loop_start_2.Counter)

# ---- group: position
item_4 = ListItem(List=loop_start_2.Data, Index="-1", Wrap=True)

# ---- group: velocity
item_5 = ListItem(List=loop_start_2.Data_2, Index="-1", Wrap=True)

# ----
preview = CustomPreview(Geometry=scale_nu.Geometry, Material=col)
number_slider_8 = Slider(100, range=0..100)
deg_2 = Degrees(Radians=number_slider_7)
item_6 = ListItem(List=random_3, Index=loop_start_2.Counter, Wrap=True)
amp = Amplitude(Vector=addition, Amplitude=Slider(1, range=0..1))
merge = Merge(Data1=simplify(pl), Data2=simplify(col), Data3=simplify(scale_nu.Geometry), Data4=simplify(pl))
panel_5 = Panel(deg_2)
multiplication_2 = Multiplication(A=item_6, B=number_slider_7)
Z_2 = UnitZ(Factor=1)
panel_6 = Panel(merge)
move = Move(Geometry=item, Motion=amp)  # -> Geometry, Transform
number_slider_9 = Slider(71, range=10..100)
number_slider_10 = Slider(100, range=0..100)
random_4 = Random(Range="0 to 1000", Number=number_slider, Seed=2, Integers=True)  # -> simplify(graft(Random))
rectangle_5 = Rectangle(Plane=PlaneXY(0, 0, 0), XSize="-50 to 50", YSize="-50 to 50", Radius=0)  # -> Rectangle, Length
vrot_2 = Rotate(Vector=item_5, Axis=Z_2, Angle=multiplication_2)
group = Group(Objects=merge)
panel_7 = Panel("-1 to 1")  # disabled
addition_2 = Addition(A=item_5, B=vrot_2)
number_slider_11 = Slider(1.413, range=0..1.571)  # disabled
merge_2 = Merge(Data1=loop_start.Data_2, Data2=flatten(amp))
merge_3 = Merge(Data1=loop_start.Data, Data2=flatten(move.Geometry))
random_5 = Random(Range=panel_7, Number=expr("x+1", number_slider_10), Seed=random_4)  # disabled
mplane = MeshPlane(Boundary=rectangle_5.Rectangle, WidthCount=number_slider_9, HeightCount=number_slider_9)  # -> Mesh, Area
number_slider_12 = Slider(0.025, range=0..1)
number_slider_13 = Slider(0, range=0..10)
loop_start_3 = LoopStart(Repeat=number_slider_10, Trigger=Button(), Data=group)  # -> port, Counter, Data
deg_3 = Degrees(Radians=number_slider_11)  # disabled
amp_2 = Amplitude(Vector=addition_2, Amplitude=Slider(1, range=0..1))
item_7 = ListItem(List=random_5, Index=loop_start_3.Counter, Wrap=True)  # disabled
demesh = DeconstructMesh(Mesh=mplane.Mesh)  # -> Vertices, Faces, Colours, Normals
loop_end = LoopEnd(
    port=loop_start.port,
    Exit=False,
    Data=simplify(merge_3),
    Data_2=simplify(merge_2),
    TimeOutVal=0,
    pausedState=False,
    state="Constant output")  # -> D0, D1
panel_8 = Panel(deg_3)  # disabled
panel_9 = Panel(loop_start_3.Counter)
ungroup = Ungroup(Group=loop_start_3.Data)
Z_3 = UnitZ(Factor=1)  # disabled
multiplication_3 = Multiplication(A=item_7, B=number_slider_11)  # disabled
number_slider_14 = Slider(6.215, range=0..20)
move_2 = Move(Geometry=item_4, Motion=amp_2)  # -> Geometry, Transform
vdisex_4 = VectorDisplayEx(Point=loop_end.D0, Vector=loop_end.D1, Colour=RGB(0, 0, 0), Width=2)
split = SplitList(List=ungroup, Index="3")  # -> ListA, ListB
simplex = SimplexNoise(Values=demesh.Vertices, Time=number_slider_13, Scale=number_slider_12)  # -> simplify(OutputNoise)
bar_graph = BarGraph(simplex, BarColor=RGB(255, 0, 90))
item_8 = ListItem(List=split.ListA, Index=0, Wrap=True)  # -> Item, Item1, Item2
Z_4 = UnitZ(Factor=1)
X_3 = UnitX(Factor=1)
multiplication_4 = Multiplication(A=simplex, B=number_slider_14)
gradient = Gradient(LowerLimit="-1", UpperLimit=1, Parameter=simplex, stops=[0: RGB(255, 255, 255), 1: RGB(187, 0, 255)])
merge_4 = Merge(Data1=loop_start_2.Data_2, Data2=simplify(amp_2))
merge_5 = Merge(Data1=loop_start_2.Data, Data2=simplify(move_2.Geometry))
deplane = DeconstructPlane(Plane=item_8.Item)  # -> Origin, XAxis, YAxis, ZAxis
vrot_3 = Rotate(Vector=deplane.XAxis, Axis=Z_3, Angle=multiplication_3)  # disabled
simplex_2 = SimplexNoise(Values=deplane.Origin, Time=number_slider_13, Scale=number_slider_12)  # -> simplify(OutputNoise)
X_4 = UnitX(Factor=1)
vrot_4 = Rotate(Vector=X_3, Axis=Z_4, Angle=multiplication_4)
multiplication_5 = Multiplication(A=simplex_2, B=number_slider_14)
Z_5 = UnitZ(Factor=1)
loop_end_2 = LoopEnd(
    port=loop_start_2.port,
    Exit=False,
    Data=simplify(merge_5),
    Data_2=simplify(merge_4),
    TimeOutVal=0,
    pausedState=False,
    state="Constant output")  # -> D0, D1
vrot_5 = Rotate(Vector=X_4, Axis=Z_5, Angle=multiplication_5)
multiplication_6 = Multiplication(A=loop_start_3.Counter, B=Slider(0.005, range=0..1))
conmesh = ConstructMesh(Vertices=demesh.Vertices, Faces=demesh.Faces, Colours=gradient)
vdisex_5 = VectorDisplayEx(Point=demesh.Vertices, Vector=vrot_4, Colour=vrot_4, Width="1")
branch = TreeBranch(Tree=loop_end_2.D0, Path="50", MaintainPaths=True)
item_9 = ListItem(List=loop_end_2.D0, Index="50", Wrap=True)
vdisex_6 = VectorDisplayEx(Point=loop_end_2.D0, Vector=loop_end_2.D1, Colour=RGB(0, 0, 0), Width=2)
pline = PolyLine(Vertices=loop_end_2.D0, Closed=False)
amp_3 = Amplitude(Vector=vrot_5, Amplitude=multiplication_6)
number_slider_15 = Slider(1, range=0..1)
addition_3 = Addition(A=deplane.XAxis, B=amp_3)
addition_4 = Addition(A=deplane.YAxis, B=amp_3)
amp_4 = Amplitude(Vector=addition_4, Amplitude=number_slider_15)
amp_5 = Amplitude(Vector=addition_3, Amplitude=number_slider_15)
move_3 = Move(Geometry=deplane.Origin, Motion=amp_5)  # -> Geometry, Transform
pl_2 = ConstructPlane(Origin=move_3.Geometry, XAxis=amp_5, YAxis=amp_4)
merge_6 = Merge(Data1=split.ListB, Data2=pl_2)
orient = Orient(Geometry=item_8.Item2, Source=item_8.Item, Target=pl_2)  # -> Geometry, Transform
merge_7 = Merge(Data1=pl_2, Data2=item_8.Item1, Data3=orient.Geometry, Data4=merge_6)  # -> simplify(Result)
group_2 = Group(Objects=merge_7)
loop_end_3 = LoopEnd(port=loop_start_3.port, Exit=False, Data=simplify(group_2), TimeOutVal=0, pausedState=False, state="Constant output")
ungroup_2 = Ungroup(Group=loop_end_3)
split_2 = SplitList(List=ungroup_2, Index="3")  # -> ListA, ListB

deplane_2 = DeconstructPlane(Plane=split_2.ListB)  # -> Origin, XAxis, YAxis, ZAxis
lng = ListLength(List=deplane_2.YAxis)
range = Range(Domain=Domain(0, 1), Steps=expr("x-1", lng))
graph = GraphMapper(range, x0=0, x1=1, y0=0, y1=1, container_name="Sine", Equation_px=[0, 0.5024467111], Equation_py=[0, 1])
dom = ConstructDomain(DomainStart=Slider(0.01, range=0..1), DomainEnd=Slider(0.3, range=0..1))
remap = RemapNumbers(Value=graph, Source=Domain(0, 1), Target=dom)  # -> Mapped, Clipped
amp_6 = Amplitude(Vector=deplane_2.YAxis, Amplitude=remap.Mapped)
rev = Reverse(Vector=amp_6)
move_4 = Move(Geometry=deplane_2.Origin, Motion=rev)  # -> Geometry, Transform
move_5 = Move(Geometry=deplane_2.Origin, Motion=amp_6)  # -> Geometry, Transform
pline_2 = PolyLine(Vertices=move_5.Geometry, Closed=False)
pline_3 = PolyLine(Vertices=move_4.Geometry, Closed=False)
merge_8 = Merge(Data1=pline_3, Data2=pline_2)
f_pmloft = PolylineMeshLoft(P=merge_8)  # -> M; inputs P: list of Polyline, C: Boolean
# ---------- f_pmloft: C# ----------
                       /*
    froGH - a sparse collection of (in)utilities for Grasshopper

    Mesh loft from Polylines with same number of points

    code by Alessio Erioli

    froGH by Co-de-iT is licensed under a Creative Commons Attribution 4.0 International License.
    http://creativecommons.org/licenses/by/4.0/

    */

    initComp();
    
    if (C && !P[0].IsClosed){
      if (P.Count > 2){
        Mesh m1, m0 = new Mesh();
        int pCount,vCount;
        Point3d[] pts0, pts1;
        pCount = P.Count;
        for (int i = 0; i < P.Count; i++){
          pts0 = P[i % pCount].ToArray();
          pts1 = P[(i + 1) % pCount].ToArray();
          vCount = pts0.Length - 1;
          for (int j = 0; j < vCount; j++){
            m1 = new Mesh();
            m1.Vertices.Add(pts0[j]);
            m1.Vertices.Add(pts0[j + 1]);
            m1.Vertices.Add(pts1[j + 1]);
            m1.Vertices.Add(pts1[j]);
            m1.Faces.AddFace(0, 1, 2, 3);
            m0.Append(m1);
          }
        }
        m0.Weld(Math.PI * 0.5);
        m0.Normals.ComputeNormals();
        M = m0;

      }else{
        Print("you need at least 3 polylines");
        M = null;
      }

    }else{
      if (P.Count > 1){
        Mesh m1, m0 = new Mesh();
        int vCount;
        Point3d[] pts0, pts1;
        for (int i = 0; i < P.Count - 1; i++){
          pts0 = P[i].ToArray();
          pts1 = P[i + 1].ToArray();
          vCount = pts0.Length - 1;
          for (int j = 0; j < vCount; j++){
            m1 = new Mesh();
            m1.Vertices.Add(pts0[j]);
            m1.Vertices.Add(pts0[j + 1]);
            m1.Vertices.Add(pts1[j + 1]);
            m1.Vertices.Add(pts1[j]);
            m1.Faces.AddFace(0, 1, 2, 3);
            m0.Append(m1);
          }
        }
        m0.Weld(Math.PI * 0.5);
        m0.Normals.ComputeNormals();
        M = m0;
      }else{
        Print("you need at least 2 polylines");
        M = null;
      }
    }
    //M = p1.ToArray(); // get points of polyline
# ---------- f_pmloft: C# additional code ----------
  void initComp(){
    Component.Name = "Polyline Mesh Loft";
    Component.NickName = "f_PMLoft";
    Component.Description = "Lofts  polylines with the same number of vertices into a mesh";
    Component.Params.Input[0].Name = "Polylines";
    Component.Params.Input[0].Description = "Lists of polylines to interpolate as mesh loft";
    Component.Params.Input[1].Name = "Closed";
    Component.Params.Input[1].Description = "True for closed loft, False for open loft";
    Component.Params.Output[0].Name = "Mesh";
    Component.Params.Output[0].Description = "Mesh Loft";
  }
# ---------- end f_pmloft ----------

item_10 = ListItem(List=split_2.ListA, Index=0, Wrap=True)  # -> Item, Item1, Item2
pline_4 = PolyLine(Vertices=split_2.ListB, Closed=False)
preview_2 = CustomPreview(Geometry=[item_10.Item2, pline_4, f_pmloft], Material=item_10.Item1)
