# Grasshopper definition simple loop template.gh (Grasshopper 1.0.7)
# Copyright: Co-de-iT
# plug-ins: Anemone

X = UnitX(Factor=1)
pt = Point(Point(0, 0, 0))
vdisex = VectorDisplayEx(Point=pt, Vector=X, Colour=RGB(0, 0, 0), Width=2)
# <title>
# 
# <description>
# 
# code by Alessio Erioli
# 
# v 0.1
loop_start = LoopStart(N=Slider(0, range=0..100), T=Button(), D0=pt, D1=X)  # -> port, Counter, Data, Data_2
merge = Merge(Data1=loop_start.Data_2)
merge_2 = Merge(Data1=loop_start.Data)
loop_end = LoopEnd(
    port=loop_start.port,
    Exit=False,
    Data=simplify(merge_2),
    Data_2=simplify(merge),
    TimeOutVal=0,
    pausedState=False,
    state="Constant output")  # -> D0, D1
