# Grasshopper definition Stigmergy strategy.gh (Grasshopper 1.0.7)
# Copyright: Co-de-iT
# plug-ins: MeshEdit Components, Weaverbird, Noise 4D

rhino_file = Panel("00_base body.3dm")
pt = Point(Point(59.71859917, 20.59108535, 48.59593454))

# ---- group: arm
mesh = Mesh(<mesh referenced from the Rhino model>)

# ----
facen = FaceNormals(Mesh=mesh)  # -> Centers, Normals
msphere = MeshSphere(Base=pt, Radius=Slider(10.25, range=0..200), UCount=10, VCount=20)
minc = MeshInclusion(Mesh=msphere, Point=facen.Centers, Strict=False)
not = GateNot(A=minc)
# Stigmergy strategy
# 
# Stigmergy on mesh + generation of displaced, print friendly, outcome.
# 
# code by Alessio Erioli
# 
# v 0.1
cullf = CullFaces(Mesh=mesh, Pattern=not)
wbcatmullclark = WeaverbirdsCatmullClarkSubdivision(MeshCurves=cullf, Level=1, SmoothNakedEdges=1)
wbloop = WeaverbirdsLoopSubdivision(MeshCurves=cullf, Level=1, SmoothNakedEdges=1)
mesh_2 = Mesh(wbloop)
demesh = DeconstructMesh(Mesh=mesh_2)  # -> Vertices, Faces, Colours, Normals
mesh_3 = Mesh(mesh_2)

# ---- group: sampling points
lng = ListLength(List=demesh.Vertices)
random = Random(Range=lng, Number=Slider(1000, range=0..3000), Seed=Slider(8, range=1..100), Integers=True)
item = ListItem(List=demesh.Vertices, Index=random, Wrap=True)
cullpt = CullDuplicates(Points=item, Tolerance=0.1, CullMode=1)  # -> Points, Indices, Valence

# ----
simplex = SimplexNoise(Values=demesh.Vertices, Time=Slider(0, range=0..10), Scale=Slider(0.03, range=0..1))
gradient = Gradient(LowerLimit="-1", UpperLimit=1, Parameter=simplex, stops=[0: RGB(0, 0, 0), 1: RGB(255, 255, 255)])
conmesh = ConstructMesh(Vertices=demesh.Vertices, Faces=demesh.Faces, Colours=gradient)
seek_radius = Slider(0.693, range=0.5..2)
seek_intensity = Slider(0.8, range=0..1)
max_speed = Slider(0.375, range=0..2)
msphere_2 = MeshSphere(Base=cullpt.Points, Radius=seek_radius, UCount=10, VCount=20)  # disabled
reset = Button()
go = BooleanToggle(False)
number_slider = Slider(0.083, range=0..1)
c_script = CSharpScript(reset=reset, go=go, M=conmesh, P=cullpt.Points, sR=seek_radius, sI=seek_intensity, mS=max_speed)  # -> out, points, vectors, tr, cols, neigh, neighCol, outMCol; inputs reset: Boolean, go: Boolean, M: Mesh, P: list of Point3d, sR: Double, sI: Double, mS: Double
# ---------- c_script: C# usings ----------
using System.Drawing;
# ---------- c_script: C# ----------
        // ............................................................................

        // return on null input
        if (M == null || P == null) return;

        // initialize on reset
        if (reset || PS == null)
        {
            PS = new ParticleSystem(P, M);
            scalarField = PopulateScalarField(M);
            //vectorField = Vf.ToArray();
            MeshPoints = PopulatePointCloud(M);

            //debug = "";
        }

        if (go)
        {
            PS.seekRadius = sR;
            PS.seekIntensity = sI;
            PS.futPosMult = 3.0f;
            PS.MaxSpeed = mS;
            PS.UpdateRTree(M);
            Component.ExpireSolution(true);
            //EvaporateMesh(M, 0.65);
            EvaporateField(scalarField, 0.98);
        }

        // extract geometries

        PS.GetPointsVectors(out pts, out vecs);

        // Print(debug);

        //debug = "";
        points = pts;
        vectors = vecs;
        //neigh = PS.GetNeighPts();
        //neighCol = PS.GetNeighBrightness();
        //if (!go)
        outMCol = GetScalarField(scalarField);
        //tr = PS.GetTrails();
        /* see this line above and the one after this commentary

        This made me bleed:

        trails are Polylines, but I initialize them with a single point (so that's not a Polyline... yet)
        If the trails are not updated by adding more points during the simulation, they will stay a single point.
        This causes a 'reference not set to an instance' exception (when something is declared but not instanced)
        the problem is that everything below this line does not compile anymore BUT THE SCRIPT EXECUTES
        so I coudn't understand why neighPts contained data but nothig was outputting.... GROAN!!!

        */
        //neigh = neighPts;


        // ............................................................................
# ---------- c_script: C# additional code ----------
 

    // ............................................................................Global Variables
    public ParticleSystem PS;
    public GH_Point[] pts;
    public GH_Vector[] vecs;
    public Polyline[] trails;
    //public static Vector3d[] vectorField;
    public static float[] scalarField;
    public static PointCloud MeshPoints;

    public static string debug;

    // ............................................................................Classes

    // .......................................................... Particle System ........

    public class ParticleSystem
    {
        // . . . . . . . . . . . . . . . . . . . . . . fields
        public List<Particle> Particles;
        public RTree MeshRTree;
        public double seekRadius;
        public double seekIntensity;
        public double futPosMult;
        public double MaxSpeed;

        // . . . . . . . . . . . . . . . . . . . . . . constructor
        public ParticleSystem(List<Point3d> positions, Mesh M)
        {
            Particles = new List<Particle>();

            for (int i = 0; i < positions.Count; i++)
                Particles.Add(new Particle(this, positions[i], RandomVector(i) * 1.5));

            MeshRTree = PopulateMeshRTree(M);
        }

        // . . . . . . . . . . . . . . . . . . . . . . methods

        public void Update(Mesh M)
        {

            foreach (Particle p in Particles)
                p.SeekMeshClosestPt(M, seekIntensity);
            foreach (Particle p in Particles)
                p.Update();

        }


        public void UpdateRTree(Mesh M)
        {

            foreach (Particle p in Particles)
            {
                // clear particle neighbours list
                p.neighbours.Clear();
                p.neighFieldPts.Clear();

                // Eventhandler function for RTree search
                EventHandler<RTreeEventArgs> rTreeCallback = (object sender, RTreeEventArgs args) =>
                  {
                      //Vector3d dir = M.Vertices[args.Id] - p.pos;
                      //if (Vector3d.VectorAngle(p.vel, dir) < Math.PI * 0.6)
                      //{
                          p.neighbours.Add(M.Vertices[args.Id]);
                          p.neighFieldPts.Add(new FieldPt(args.Id, scalarField[args.Id]));
                      //}
                  };

                MeshRTree.Search(new Sphere(M.ClosestPoint(p.pos + p.vel * futPosMult), seekRadius), rTreeCallback);

                // p.SeekNeighbours(seekIntensity);
                p.SeekColor(seekIntensity);

                //// update scalar field
                int ind = MeshPoints.ClosestPoint(p.pos);
                scalarField[ind] += p.PheroStrength;

                if (scalarField[ind] > 1) scalarField[ind] = 1;

            }

            foreach (Particle p in Particles)
                p.Update();

        }

        public void GetPointsVectors(out GH_Point[] pts, out GH_Vector[] vecs)
        {
            pts = new GH_Point[Particles.Count];
            vecs = new GH_Vector[Particles.Count];

            for (int i = 0; i < Particles.Count; i++)
            {
                pts[i] = new GH_Point(Particles[i].pos);
                vecs[i] = new GH_Vector(Particles[i].vel);
            }
        }

        public Polyline[] GetTrails()
        {
            Polyline[] trails = new Polyline[Particles.Count];
            for (int i = 0; i < Particles.Count; i++)
            {
                trails[i] = Particles[i].trail;
            }
            return trails;
        }

        public DataTree<GH_Point> GetNeighPts()
        {
            DataTree<GH_Point> ptsOut = new DataTree<GH_Point>();

            for (int i = 0; i < Particles.Count; i++)
                ptsOut.EnsurePath(new GH_Path(i));

            for (int i = 0; i < Particles.Count; i++)
            {
                for (int j = 0; j < Particles[i].neighbours.Count; j++)
                    ptsOut.Add(new GH_Point(Particles[i].neighbours[j]), new GH_Path(i));
            }


            return ptsOut;
        }

        public DataTree<GH_Vector> GetNeighVectors()
        {

            DataTree<GH_Vector> vecOut = new DataTree<GH_Vector>();

            for (int i = 0; i < Particles.Count; i++)
                vecOut.EnsurePath(new GH_Path(i));

            for (int i = 0; i < Particles.Count; i++)
            {
                for (int j = 0; j < Particles[i].neighFieldPts.Count; j++)
                    vecOut.Add(new GH_Vector(Particles[i].neighFieldPts[j].v), new GH_Path(i));
            }

            return vecOut;
        }

        public DataTree<GH_Number> GetNeighBrightness()
        {

            DataTree<GH_Number> briOut = new DataTree<GH_Number>();

            for (int i = 0; i < Particles.Count; i++)
                briOut.EnsurePath(new GH_Path(i));

            for (int i = 0; i < Particles.Count; i++)
            {
                for (int j = 0; j < Particles[i].neighFieldPts.Count; j++)
                    briOut.Add(new GH_Number(Particles[i].neighFieldPts[j].bri), new GH_Path(i));
            }

            return briOut;
        }
    }

    // .......................................................... Particle ...............
    public class Particle
    {
        public ParticleSystem PSys;
        public Point3d pos;
        public Vector3d vel;
        public Vector3d acc;
        public float PheroStrength;
        public Polyline trail;
        public List<Point3d> neighbours;
        public List<FieldPt> neighFieldPts;

        public Particle(ParticleSystem PSys, Point3d pos, Vector3d vel)
        {
            this.PSys = PSys;
            this.pos = pos;
            this.vel = vel;
            acc = Vector3d.Zero;
            PheroStrength = 0.1f;
            trail = new Polyline { this.pos };
            neighbours = new List<Point3d>();
            neighFieldPts = new List<FieldPt>();
        }

        public void Update()
        {
            Move();
            //trail.Add(pos);
        }

        public void SeekNeighbours(double seekIntensity)
        {
            acc = vel;

            if (neighbours.Count > 0)
            {
                acc = Vector3d.Zero;
                Vector3d desired = Vector3d.Zero;

                foreach (Point3d n in neighbours)
                {
                    //Vector3d dir = n - pos;
                    //if (Vector3d.VectorAngle(vel, dir) < Math.PI * 0.6)
                    desired += n - pos;
                }

                desired /= neighbours.Count;
                desired.Unitize();
                desired *= PSys.MaxSpeed;

                acc = (desired - vel) * seekIntensity;
            }
        }

        public void SeekColor(double seekIntensity)
        {
            acc = vel;

            if (neighFieldPts.Count > 0)
            {
                acc = Vector3d.Zero;
                Vector3d desired = Vector3d.Zero;
                double bri;
                double MaxBri = -1.0;
                int MaxInd = -1;

                for (int i = 0; i < neighFieldPts.Count; i++)
                {
                    bri = neighFieldPts[i].bri; // brightness is 0-1 and RGB 0-255
                    if (bri > MaxBri)
                    {
                        MaxBri = bri;
                        MaxInd = i;
                    }

                }
                desired += neighbours[MaxInd] - pos;

                desired.Unitize();
                desired *= PSys.MaxSpeed;

                acc = (desired - vel) * seekIntensity;
            }
        }

        public void SeekMeshClosestPt(Mesh M, double seekIntensity)
        {
            acc = Vector3d.Zero;
            MeshPoint mP = M.ClosestMeshPoint(pos + vel * 1.5, 100);
            if (mP != null)
            {
                Point3d mCP = mP.Point;

                Vector3d desired = mCP - pos;
                desired.Unitize();
                desired *= PSys.MaxSpeed;

                acc = (desired - vel) * seekIntensity;
            }

        }

        public void Move()
        {
            //vel = vel * 0.9 + acc * 0.1;
            vel = vel + acc;
            if (vel.Length > PSys.MaxSpeed)
            {
                vel.Unitize();
                vel *= PSys.MaxSpeed;
            }
            if (vel.Length < PSys.MaxSpeed * 0.1)
            {
                vel.Unitize();
                vel *= PSys.MaxSpeed * 0.1;
            }
            pos += vel;
        }


    }

    public class FieldPt
    {
        public int id;
        public float bri;
        public Vector3d v;

        public FieldPt(int id, float bri, Vector3d v)
        {
            this.id = id;
            this.bri = bri;
            this.v = v;
        }

        public FieldPt(int id, float bri) : this(id, bri, Vector3d.Zero) { }

    }

    // ............................................................................Utilities

    public GH_Number[] GetScalarField(float[] scalarField)
    {
        GH_Number[] outField = new GH_Number[scalarField.Length];


        for (int i = 0; i < scalarField.Length; i++)
        {
            outField[i] = new GH_Number(scalarField[i]);
        }

        return outField;
    }

    public static void EvaporateMesh(Mesh M, double evapoRatio)
    {
        if (M.VertexColors.Count == 0) return;
        double b;
        int c;
        for (int i = 0; i < M.VertexColors.Count; i++)
        {
            b = M.VertexColors[i].R;
            b *= evapoRatio;
            c = (int)b;
            M.VertexColors[i] = Color.FromArgb(c, c, c);
        }

    }

    public static void EvaporateField(float[] scalarField, double evapoRatio)
    {
        float evap = (float)evapoRatio;

        for (int i = 0; i < scalarField.Length; i++)
        {
            scalarField[i] *= evap;
        }
    }

    public float[] PopulateScalarField(Mesh M)
    {
        float[] scalarField = new float[M.Vertices.Count];

        if (M.VertexColors.Count != 0)
        {

            for (int i = 0; i < M.VertexColors.Count; i++)
            {
                scalarField[i] = M.VertexColors[i].GetBrightness();

            }
        }
        return scalarField;
    }

    public static RTree PopulateMeshRTree(Mesh M)
    {
        RTree rt = new RTree();

        for (int i = 0; i < M.Vertices.Count; i++)
        {
            rt.Insert((Point3d)M.Vertices[i], i);
        }

        return rt;
    }

    public PointCloud PopulatePointCloud(Mesh M)
    {
        PointCloud mP = new PointCloud();

        for (int i = 0; i < M.Vertices.Count; i++)
        {
            mP.Add(M.Vertices[i], M.Normals[i]);
        }

        return mP;
    }

    public static Vector3d RandomVector(int seed)
    {
        Vector3d r = Vector3d.Zero;
        Random rnd = new Random(seed);
        r = new Vector3d((rnd.NextDouble() * 2) - 1, (rnd.NextDouble() * 2) - 1, (rnd.NextDouble() * 2) - 1);
        return r;
    }
# ---------- end c_script ----------
amp = Amplitude(Vector=c_script.vectors, Amplitude=number_slider)
swatch = ColourSwatch(SwatchColor=RGB(0, 242, 255))
frgb = ColourRGBF(Alpha=1, Red=0, Green=c_script.outMCol, Blue=c_script.outMCol)
cloud = CloudDisplay(Points=c_script.points, Colours=swatch, Size=number_slider, SpriteType=0)
post_process = BooleanToggle(False)
conmesh_2 = ConstructMesh(Vertices=demesh.Vertices, Faces=demesh.Faces, Colours=frgb)
vdisex = VectorDisplayEx(Point=c_script.points, Vector=amp, Colour=swatch, Width="1")
filter = StreamFilter(Gate=post_process, Stream1=c_script.outMCol)
filter_2 = StreamFilter(Gate=post_process, Stream1=conmesh_2)
filter_3 = StreamFilter(Gate=post_process, Stream1=demesh.Vertices)
filter_4 = StreamFilter(Gate=post_process, Stream1=demesh.Faces)
filter_5 = StreamFilter(Gate=post_process, Stream1=mesh_3)
filter_6 = StreamFilter(Gate=post_process, Stream1=demesh.Normals)
smooth_values = BooleanToggle(True)

# ---- group: Smoothing values (optional)
mblur = BlurMesh(Mesh=filter_2, Iterations=Slider(1, range=0..10))
demesh_2 = DeconstructMesh(Mesh=mblur)  # -> Vertices, Faces, Colours, Normals
ahsv = SplitAHSV(Colour=demesh_2.Colours)  # -> Alpha, Hue, Saturation, Value
filter_7 = StreamFilter(Gate=smooth_values, Stream0=filter, Stream1=ahsv.Value)

# ---- group: displacement modulation / geometry controlled
geo = Geometry(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)
geo_2 = Geometry(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)
pull = PullPoint(Point=filter_3, Geometry=geo_2, ClosestOnly=True)  # -> ClosestPoint, Distance

# ---- group: displacement modulation / by coordinates values
pdecon = Deconstruct(Point=filter_3)  # -> XComponent, YComponent, ZComponent

# ---- group: displacement modulation
num = Number(pdecon.XComponent)
bnd = Bounds(Numbers=flatten(num))
remap = RemapNumbers(Value=num, Source=bnd, Target=Domain(0, 1))  # -> Mapped, Clipped
graph = GraphMapper(
    remap.Mapped,
    x0=0,
    x1=1,
    y0=0,
    y1=1,
    container_name="Bezier2",
    pt=[Point(0, 0, 0), Point(0.227272734, 0, 0), Point(0.200000003, 1, 0), Point(0.5, 1, 0), Point(0.7969697118, 1, 0), Point(0.7762893438, 0, 0), Point(1, 0, 0)])

# ----
displacement = ValueList({"both sides": 0, "front side": 1, "back side": 2}, selected="front side")
min_thickness = Slider(0.15, range=0..5)
additional_max_thickness = Slider(2.712, range=0..5)
graph_2 = GraphMapper(remap.Mapped, x0=0, x1=1, y0=0, y1=1, container_name="Bezier", cpx=[0, 0.7168890834, 0.8034492135, 1], cpy=[1, 1, 0, 0])

# ---- group: displacement / original
mesh_4 = Mesh(filter_5)

# ---- group: displacement
filter_8 = StreamFilter(Gate=post_process, Stream1=filter_7)
dom = ConstructDomain(DomainStart=0, DomainEnd=additional_max_thickness)
remap_2 = RemapNumbers(Value=filter_8, Source=Domain(0, 1), Target=dom)  # -> Mapped, Clipped
multiplication = Multiplication(A=remap_2.Mapped, B=graph)
addition = Addition(A=min_thickness, B=multiplication)
amp_2 = Amplitude(Vector=filter_6, Amplitude=addition)
rev = Reverse(Vector=amp_2)
move = Move(Geometry=filter_3, Motion=amp_2)  # -> Geometry, Transform
move_2 = Move(Geometry=filter_3, Motion=rev)  # -> Geometry, Transform

# ---- group: displacement / front side
conmesh_3 = ConstructMesh(Vertices=move.Geometry, Faces=filter_4)

# ---- group: displacement / back side
conmesh_4 = ConstructMesh(Vertices=move_2.Geometry, Faces=filter_4)

# ---- group: displacement (continued)
filter_9 = StreamFilter(Gate=displacement, Stream0=[conmesh_3, conmesh_4], Stream1=[conmesh_3, mesh_4], Stream2=[mesh_4, conmesh_4])
wbcatmullclark_2 = WeaverbirdsCatmullClarkSubdivision(MeshCurves=filter_9, Level=1, SmoothNakedEdges=0)  # -> flatten(OutputMeshCurves)
wbnaked = WeaverbirdsNakedBoundary(MeshClosedPolylines=graft(wbcatmullclark_2))
flip = FlipMatrix(Data=wbnaked)
f_pmloft = PolylineMeshLoft(P=flip)  # -> M; inputs P: list of Polyline, C: Boolean
# ---------- f_pmloft: C# ----------
                       /*
    froGH - a sparse collection of (in)utilities for Grasshopper

    Mesh loft from Polylines with same number of points

    code by Alessio Erioli

    froGH by Co-de-iT is licensed under a Creative Commons Attribution 4.0 International License.
    http://creativecommons.org/licenses/by/4.0/

    */

    initComp();
    
    if (C && !P[0].IsClosed){
      if (P.Count > 2){
        Mesh m1, m0 = new Mesh();
        int pCount,vCount;
        Point3d[] pts0, pts1;
        pCount = P.Count;
        for (int i = 0; i < P.Count; i++){
          pts0 = P[i % pCount].ToArray();
          pts1 = P[(i + 1) % pCount].ToArray();
          vCount = pts0.Length - 1;
          for (int j = 0; j < vCount; j++){
            m1 = new Mesh();
            m1.Vertices.Add(pts0[j]);
            m1.Vertices.Add(pts0[j + 1]);
            m1.Vertices.Add(pts1[j + 1]);
            m1.Vertices.Add(pts1[j]);
            m1.Faces.AddFace(0, 1, 2, 3);
            m0.Append(m1);
          }
        }
        m0.Weld(Math.PI * 0.5);
        m0.Normals.ComputeNormals();
        M = m0;

      }else{
        Print("you need at least 3 polylines");
        M = null;
      }

    }else{
      if (P.Count > 1){
        Mesh m1, m0 = new Mesh();
        int vCount;
        Point3d[] pts0, pts1;
        for (int i = 0; i < P.Count - 1; i++){
          pts0 = P[i].ToArray();
          pts1 = P[i + 1].ToArray();
          vCount = pts0.Length - 1;
          for (int j = 0; j < vCount; j++){
            m1 = new Mesh();
            m1.Vertices.Add(pts0[j]);
            m1.Vertices.Add(pts0[j + 1]);
            m1.Vertices.Add(pts1[j + 1]);
            m1.Vertices.Add(pts1[j]);
            m1.Faces.AddFace(0, 1, 2, 3);
            m0.Append(m1);
          }
        }
        m0.Weld(Math.PI * 0.5);
        m0.Normals.ComputeNormals();
        M = m0;
      }else{
        Print("you need at least 2 polylines");
        M = null;
      }
    }
    //M = p1.ToArray(); // get points of polyline
# ---------- f_pmloft: C# additional code ----------
  void initComp(){
    Component.Name = "Polyline Mesh Loft";
    Component.NickName = "f_PMLoft";
    Component.Description = "Lofts  polylines with the same number of vertices into a mesh";
    Component.Params.Input[0].Name = "Polylines";
    Component.Params.Input[0].Description = "Lists of polylines to interpolate as mesh loft";
    Component.Params.Input[1].Name = "Closed";
    Component.Params.Input[1].Description = "True for closed loft, False for open loft";
    Component.Params.Output[0].Name = "Mesh";
    Component.Params.Output[0].Description = "Mesh Loft";
  }
# ---------- end f_pmloft ----------
mjoin = MeshJoin(Meshes=flatten([f_pmloft, wbcatmullclark_2]))
weldvertices = MeshWeldVertices(Mesh=mjoin, Tolerance=0.01)  # -> RuntimeMessage, Mesh
unifynormals = MeshUnifyNormals(Mesh=weldvertices.Mesh)
preview = CustomPreview(Geometry=unifynormals, Material=ColourSwatch(SwatchColor=RGB(255, 255, 255)))
