# Grasshopper definition day 02-00_in class.gh (Grasshopper 1.0.7)
# Copyright: Co-de-iT
# plug-ins: Anemone, Bifocals, Weaverbird

mesh = Mesh(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)
wbcatmullclark = WeaverbirdsCatmullClarkSubdivision(MeshCurves=mesh, Level="3", SmoothNakedEdges="0")
wbcatmullclark_2 = WeaverbirdsCatmullClarkSubdivision(MeshCurves=wbcatmullclark, Level="1", SmoothNakedEdges="0")
facen = FaceNormals(Mesh=wbcatmullclark_2)  # -> Centers, Normals
reduce = RandomReduce(List=facen.Centers, Reduction="500", Seed=1)
# <title>
# 
# <description>
# 
# code by Alessio Erioli
# 
# v 0.1
number_slider = Slider(50, range=0..200)
pt = Point(simplify(graft(reduce)))
loop_start = LoopStart(Repeat=number_slider, Trigger=Button(), Data=pt)  # -> port, Counter, Data; disabled
item = ListItem(List=loop_start.Data, Index="-1", Wrap=True)
Z = UnitZ(Factor=Slider(-1, range=-1..0))
wbcatmullclark_3 = WeaverbirdsCatmullClarkSubdivision(MeshCurves=wbcatmullclark_2, Level="1", SmoothNakedEdges="0")
move = Move(Geometry=item, Motion=Z)  # -> Geometry, Transform
panel = Panel(wbcatmullclark_3)
meshcp = MeshClosestPoint(Point=move.Geometry, Mesh=wbcatmullclark_3)  # -> Point, Index, Parameter
merge = Merge(Data1=loop_start.Data, Data2=simplify(meshcp.Point))
loop_end = LoopEnd(port=loop_start.port, Exit=False, Data=merge, TimeOutVal=0, pausedState=False, state="Constant output")
pline = PolyLine(Vertices=loop_end, Closed=False)
