# Grasshopper definition day 02-01_in class.gh (Grasshopper 1.0.7)
# Copyright: Co-de-iT
# plug-ins: Anemone, Bifocals

# https://tinyurl.com/TALM-day01
# https://tinyurl.com/TALM-day02
# https://tinyurl.com/TALM-utils
mesh = Mesh(<mesh referenced from the Rhino model>)
facen = FaceNormals(Mesh=mesh)  # -> Centers, Normals
pt = Point(Point(0, 0, 129.9706923))
pt_2 = Point(Point(-6.992366124, 8.05734951, 0))
pt_3 = Point(Point(-3.591201795, -4.351722853, 0))
pt_4 = Point(Point(3.71437449, 3.024486392, 0))
pt_5 = Point(Point(4.715662045, -4.913310202, 0))
mplane = MeshPlane(Boundary={Plane=PlaneXY(0, 0, 0), Size=Domain2(u=-10..10, v=-10..10)}, WidthCount="50", HeightCount="50")  # -> Mesh, Area
facen_2 = FaceNormals(Mesh=mplane.Mesh)  # -> Centers, Normals
reduce = RandomReduce(List=facen_2.Centers, Reduction="2400", Seed=1)
lng = ListLength(List=reduce)
random = Random(Range=Domain(0, 1), Number=lng, Seed=2, Integers=True)
msphere = MeshSphere(Base=pt, Radius=Slider(25, range=0..50), UCount=10, VCount=20)
subtraction = Subtraction(A=random, B="0.5")
merge = Merge(Data1=pt_2, Data2=pt_4, Data3=pt_3, Data4=pt_5)
multiplication = Multiplication(A=subtraction, B="2")
minc = MeshInclusion(Mesh=msphere, Point=facen.Centers, Strict=False)
demesh = DeconstructMesh(Mesh=mplane.Mesh)  # -> Vertices, Faces, Colours, Normals
not = GateNot(A=minc)
fspin = SpinForce(Plane=reduce, Strength=multiplication, Radius=Slider(0.756, range=0..10), Decay=2)
pcharge = PointCharge(Point=merge, Charge=1, Decay=2)
# <title>
# 
# <description>
# 
# code by Alessio Erioli
# 
# v 0.1
cullf = CullFaces(Mesh=mesh, Pattern=not)
demesh_2 = DeconstructMesh(Mesh=cullf)  # -> Vertices, Faces, Colours, Normals
number_slider = Slider(3, range=0..100)
mergef = MergeFields(Fields=fspin)
mergef_2 = MergeFields(Fields=pcharge)
panel = Panel(mergef_2)
lng_2 = ListLength(List=demesh_2.Vertices)
evf = EvaluateField(Field=mergef, Point=demesh.Vertices)  # -> Tensor, Strength
vlen = VectorLength(Vector=evf.Tensor)
multiplication_2 = Multiplication(A=lng_2, B=Slider(0.97, range=0..1))
preview = CustomPreview(Geometry=cullf, Material=ColourSwatch(SwatchColor=RGB(255, 255, 255)))
bnd = Bounds(Numbers=vlen)
dom = ConstructDomain(DomainStart=Slider(0.454, range=0..3), DomainEnd=Slider(0.463, range=0..3))
reduce_2 = RandomReduce(List=demesh_2.Normals, Reduction=multiplication_2, Seed=number_slider)
reduce_3 = RandomReduce(List=demesh_2.Vertices, Reduction=multiplication_2, Seed=number_slider)
remap = RemapNumbers(Value=vlen, Source=bnd, Target=dom)  # -> Mapped, Clipped
mesh_2 = Mesh(cullf)
facen_3 = FaceNormals(Mesh=mesh_2)  # -> Centers, Normals
number_slider_2 = Slider(1.78, range=0..5)
pl = PlaneNormal(Origin=reduce_3, ZAxis=reduce_2)
amp = Amplitude(Vector=evf.Tensor, Amplitude=Slider(0.38, range=0..1))
amp_2 = Amplitude(Vector=evf.Tensor, Amplitude=remap.Mapped)
pt_6 = Point(Point(0, 8.994312343, 147.6775811))
vdisex = VectorDisplayEx(Point=demesh.Vertices, Vector=amp, Colour=RGB(0, 0, 0), Width=2)
mirror = Mirror(Geometry=pl, Plane=PlaneYZ(0, 0, 0))  # -> Geometry, Transform
msphere_2 = MeshSphere(Base=pt_6, Radius=Slider(5, range=0..50), UCount=10, VCount=20)
fspin_2 = SpinForce(Plane=[pl, mirror.Geometry], Strength=1, Radius=Slider(5, range=0..5), Decay=2)
minc_2 = MeshInclusion(Mesh=msphere_2, Point=facen_3.Centers, Strict=False)
mergef_3 = MergeFields(Fields=fspin_2)
not_2 = GateNot(A=minc_2)
evf_2 = EvaluateField(Field=mergef_3, Point=demesh_2.Vertices)  # -> Tensor, Strength
cullf_2 = CullFaces(Mesh=mesh_2, Pattern=not_2)
facen_4 = FaceNormals(Mesh=cullf_2)  # -> Centers, Normals
amp_3 = Amplitude(Vector=evf_2.Tensor, Amplitude=Slider(0.567, range=0..1))
yz = YZPlane(Origin=Point(0, 0, 0))
reduce_4 = RandomReduce(List=facen_4.Centers, Reduction="100", Seed=1)
vdisex_2 = VectorDisplayEx(Point=demesh_2.Vertices, Vector=amp_3, Colour=RGB(0, 0, 0), Width=2)
mirror_2 = Mirror(Geometry=reduce_4, Plane=yz)  # -> Geometry, Transform
merge_2 = Merge(Data1=reduce_4, Data2=mirror_2.Geometry)
meshcp = MeshClosestPoint(Point=merge_2, Mesh=mesh_2)  # -> simplify(graft(Point)), Index, Parameter
loop_start = LoopStart(Repeat=Slider(80, range=0..100), Trigger=Button(), Data=meshcp.Point)  # -> port, Counter, Data; disabled
item = ListItem(List=loop_start.Data, Index="-1", Wrap=True)
evf_3 = EvaluateField(Field=mergef_3, Point=item)  # -> Tensor, Strength
amp_4 = Amplitude(Vector=evf_3.Tensor, Amplitude=Slider(0.2, range=0..1))
move = Move(Geometry=item, Motion=amp_4)  # -> Geometry, Transform
meshcp_2 = MeshClosestPoint(Point=move.Geometry, Mesh=mesh_2)  # -> Point, Index, Parameter
merge_3 = Merge(Data1=loop_start.Data, Data2=simplify(meshcp_2.Point))
loop_end = LoopEnd(port=loop_start.port, Exit=False, Data=merge_3, TimeOutVal=0, pausedState=False, state="Constant output")
pline = PolyLine(Vertices=loop_end, Closed=False)
