# Grasshopper definition day 03-00_in class.gh (Grasshopper 1.0.7)
# Copyright: Co-de-iT
# plug-ins: Volvox, Anemone, Bifocals, Weaverbird, Mesh Pipe

# https://tinyurl.com/TALM-day01
# https://tinyurl.com/TALM-day02
# https://tinyurl.com/TALM-utils
mesh = Mesh(<mesh referenced from the Rhino model>)
facen = FaceNormals(Mesh=mesh)  # -> Centers, Normals
pt = Point(Point(0, 0, 161.5107193))
pt_2 = Point(Point(-6.992366124, 8.05734951, 0))
pt_3 = Point(Point(-3.591201795, -4.351722853, 0))
pt_4 = Point(Point(3.71437449, 3.024486392, 0))
pt_5 = Point(Point(4.715662045, -4.913310202, 0))
mplane = MeshPlane(Boundary={Plane=PlaneXY(0, 0, 0), Size=Domain2(u=-10..10, v=-10..10)}, WidthCount="50", HeightCount="50")  # -> Mesh, Area
facen_2 = FaceNormals(Mesh=mplane.Mesh)  # -> Centers, Normals
reduce = RandomReduce(List=facen_2.Centers, Reduction="2400", Seed=1)
lng = ListLength(List=reduce)
random = Random(Range=Domain(0, 1), Number=lng, Seed=2, Integers=True)
msphere = MeshSphere(Base=pt, Radius=Slider(20, range=0..50), UCount=10, VCount=20)
subtraction = Subtraction(A=random, B="0.5")
merge = Merge(Data1=pt_2, Data2=pt_4, Data3=pt_3, Data4=pt_5)
multiplication = Multiplication(A=subtraction, B="2")
minc = MeshInclusion(Mesh=msphere, Point=facen.Centers, Strict=False)
demesh = DeconstructMesh(Mesh=mplane.Mesh)  # -> Vertices, Faces, Colours, Normals
not = GateNot(A=minc)
fspin = SpinForce(Plane=reduce, Strength=multiplication, Radius=Slider(0.756, range=0..10), Decay=2)
pcharge = PointCharge(Point=merge, Charge=1, Decay=2)
# <title>
# 
# <description>
# 
# code by Alessio Erioli
# 
# v 0.1
cullf = CullFaces(Mesh=mesh, Pattern=not)
mergef = MergeFields(Fields=fspin)
mergef_2 = MergeFields(Fields=pcharge)
panel = Panel(mergef_2)
wboffset = WeaverbirdsOffsetMesh(MeshCurves=cullf, Distance=Slider(0.25, range=0..1), OffsetType=0)
evf = EvaluateField(Field=mergef, Point=demesh.Vertices)  # -> Tensor, Strength
vlen = VectorLength(Vector=evf.Tensor)
preview = CustomPreview(Geometry=cullf, Material=ColourSwatch(SwatchColor=RGB(255, 255, 255)))  # disabled
bnd = Bounds(Numbers=vlen)
dom = ConstructDomain(DomainStart=Slider(0.454, range=0..3), DomainEnd=Slider(0.463, range=0..3))
mesh_2 = Mesh(wboffset)
demesh_2 = DeconstructMesh(Mesh=mesh_2)  # -> Vertices, Faces, Colours, Normals
lng_2 = ListLength(List=demesh_2.Vertices)
remap = RemapNumbers(Value=vlen, Source=bnd, Target=dom)  # -> Mapped, Clipped
multiplication_2 = Multiplication(A=lng_2, B=Slider(0.98, range=0..1))
facen_3 = FaceNormals(Mesh=mesh_2)  # -> Centers, Normals
amp = Amplitude(Vector=evf.Tensor, Amplitude=Slider(0.38, range=0..1))
amp_2 = Amplitude(Vector=evf.Tensor, Amplitude=remap.Mapped)
reduce_2 = RandomReduce(List=demesh_2.Normals, Reduction=multiplication_2, Seed=1)
reduce_3 = RandomReduce(List=demesh_2.Vertices, Reduction=multiplication_2, Seed=1)
pt_6 = Point(Point(-4.057879833, -4.43932328, 162.0370554))
pt_7 = Point(Point(-3.137447726, -7.870504989, 161.5989448))
vdisex = VectorDisplayEx(Point=demesh.Vertices, Vector=amp, Colour=RGB(0, 0, 0), Width=2)
msphere_2 = MeshSphere(Base=pt_7, Radius=Slider(2, range=0..50), UCount=10, VCount=20)
msphere_3 = MeshSphere(Base=pt_6, Radius=Slider(6, range=0..50), UCount=10, VCount=20)
mirror = Mirror(Geometry=pt_7, Plane=PlaneYZ(0, 0, 0))  # -> Geometry, Transform
number_slider = Slider(1.78, range=0..5)
pl = PlaneNormal(Origin=reduce_3, ZAxis=reduce_2)
minc_2 = MeshInclusion(Mesh=msphere_3, Point=facen_3.Centers, Strict=False)
minc_3 = MeshInclusion(Mesh=msphere_2, Point=facen_3.Centers, Strict=False)
pcharge_2 = PointCharge(Point=[pt_7, mirror.Geometry], Charge=1, Decay=2)
mirror_2 = Mirror(Geometry=pl, Plane=PlaneYZ(0, 0, 0))  # -> Geometry, Transform
not_2 = GateNot(A=minc_2)
nor = GateNor(A=not_2, B=minc_3)
fspin_2 = SpinForce(Plane=[pl, mirror_2.Geometry], Strength=1, Radius=Slider(2, range=0..5), Decay=2)
not_3 = GateNot(A=nor)
cullf_2 = CullFaces(Mesh=mesh_2, Pattern=not_3)
mergef_3 = MergeFields(Fields=flatten([fspin_2, pcharge_2]))
facen_4 = FaceNormals(Mesh=cullf_2)  # -> Centers, Normals
evf_2 = EvaluateField(Field=mergef_3, Point=demesh_2.Vertices)  # -> Tensor, Strength; disabled
lng_3 = ListLength(List=facen_4.Centers)
amp_3 = Amplitude(Vector=evf_2.Tensor, Amplitude=Slider(0.567, range=0..1))
multiplication_3 = Multiplication(A=lng_3, B=Slider(0.92, range=0..1))
vdisex_2 = VectorDisplayEx(Point=demesh_2.Vertices, Vector=amp_3, Colour=RGB(0, 0, 0), Width=2)
reduce_4 = RandomReduce(List=facen_4.Centers, Reduction=multiplication_3, Seed=1)
yz = YZPlane(Origin=Point(0, 0, 0))
mirror_3 = Mirror(Geometry=reduce_4, Plane=yz)  # -> Geometry, Transform
merge_2 = Merge(Data1=reduce_4, Data2=mirror_3.Geometry)
number_slider_2 = Slider(80, range=0..100)
meshcp = MeshClosestPoint(Point=merge_2, Mesh=mesh_2)  # -> simplify(graft(Point)), Index, Parameter
loop_start = LoopStart(Repeat=number_slider_2, Trigger=Button(), Data=meshcp.Point)  # -> port, Counter, Data
division = Division(A=loop_start.Counter, B=number_slider_2)
item = ListItem(List=loop_start.Data, Index="-1", Wrap=True)
graph = GraphMapper(division, x0=0, x1=1, y0=0, y1=1, container_name="Sine", Equation_px=[0, 1], Equation_py=[0, 1])
evf_3 = EvaluateField(Field=mergef_3, Point=item)  # -> Tensor, Strength
amp_4 = Amplitude(Vector=evf_3.Tensor, Amplitude=Slider(0.2, range=0..1))
move = Move(Geometry=item, Motion=amp_4)  # -> Geometry, Transform
facen_5 = FaceNormals(Mesh=mesh_2)  # -> Centers, Normals
meshcp_2 = MeshClosestPoint(Point=move.Geometry, Mesh=mesh_2)  # -> Point, Index, Parameter
item_2 = ListItem(List=facen_5.Normals, Index=meshcp_2.Index, Wrap=True)
vec2pt = Vector2Pt(PointA=move.Geometry, PointB=meshcp_2.Point, Unitize=False)  # -> Vector, Length
multiplication_4 = Multiplication(A=graph, B=vec2pt.Vector)
multiplication_5 = Multiplication(A=graph, B=Slider(1, range=0..1))
angle = Angle(VectorA=vec2pt.Vector, VectorB=item_2)  # -> Angle, Reflex
move_2 = Move(Geometry=meshcp_2.Point, Motion=multiplication_4)  # -> Geometry, Transform
amp_5 = Amplitude(Vector=item_2, Amplitude=multiplication_5)
move_3 = Move(Geometry=meshcp_2.Point, Motion=amp_5)  # -> Geometry, Transform
larger = LargerThan(FirstNumber=angle.Angle, SecondNumber="Pi*0.5")  # -> LargerThan, OrEqualTo
vdisex_3 = VectorDisplayEx(Point=meshcp_2.Point, Vector=amp_5, Colour=RGB(0, 0, 0), Width=2)
# backplate
crv = Curve(Tree({0}: [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], {1}: [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], {2}: [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], {3}: [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], {4}: [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], {5}: [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]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))
weave = Weave(Pattern=larger.LargerThan, Stream0=meshcp_2.Point, Stream1=move.Geometry, NullGaps=False)
merge_3 = Merge(Data1=loop_start.Data, Data2=simplify(weave))
# masks
crv_2 = Curve(Tree({0}: [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], {1}: [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], {2}: [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], {3}: [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], {4}: [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], {5}: [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]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))
crv_3 = Curve(Tree({0}: [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], {1}: [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], {2}: [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], {3}: [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], {4}: [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], {5}: [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]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))
crv_4 = Curve(Tree({0}: [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], {1}: [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], {2}: [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], {3}: [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], {4}: [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], {5}: [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]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))
crv_5 = Curve(Tree({0}: [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], {1}: [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], {2}: [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], {3}: [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], {4}: [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], {5}: [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]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))
# nice one
pt_8 = Point(Tree({0}: [Point(-6.715535171, -2.887072692, 160.2440852), Point(-6.680697434, -3.000603512, 160.0831595), Point(-6.64392152, -3.100270536, 159.9137074), Point(-6.606915587, -3.173776376, 159.7314234), Point(-6.573203189, -3.207361511, 159.5371671), Point(-6.54659619, -3.194429371, 159.3393671)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], {1}: [Point(-7.616866357, -0.08770801852, 161.250753), Point(-7.687583648, -0.2672309748, 161.1981168), Point(-7.740027669, -0.4509238236, 161.1389005), Point(-7.773449232, -0.6358702483, 161.0705059), Point(-7.790917508, -0.8197633837, 160.9938367), Point(-7.794292853, -1.001700856, 160.9108465)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], {2}: [Point(-7.204177997, -0.8971513564, 163.4785702), Point(-7.209467818, -1.091903221, 163.4333626), Point(-7.218006116, -1.288099688, 163.3954938), Point(-7.22979823, -1.482646343, 163.3506324), Point(-7.243765278, -1.672716699, 163.2899844), Point(-7.258402768, -1.855365652, 163.2098276)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], {3}: [Point(-5.117707383, -6.76895156, 161.749191), Point(-5.230864958, -6.66409032, 161.6219138), Point(-5.298359867, -6.583103695, 161.4519562), Point(-5.29707383, -6.552164968, 161.2543679), Point(-5.252290457, -6.581317567, 161.064516), Point(-5.187624382, -6.654464571, 160.8976409)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], {4}: [Point(-7.465029362, -0.1217741596, 160.1192014), Point(-7.496134961, -0.236548022, 159.9583928), Point(-7.512510672, -0.294388541, 159.7676408), Point(-7.532681663, -0.2644157395, 159.570931), Point(-7.561049692, -0.2110658751, 159.3802767), Point(-7.597785973, -0.06697604794, 159.2465286)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], {5}: [Point(-5.194316185, -6.782959419, 160.3047701), Point(-5.07713911, -6.888989409, 160.1841001), Point(-4.958083439, -6.989800199, 160.0610101), Point(-4.843015702, -7.083452591, 159.9299905), Point(-4.737455934, -7.168925607, 159.7864611), Point(-4.644079491, -7.237888846, 159.6271398)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]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))
loop_end = LoopEnd(port=loop_start.port, Exit=False, Data=merge_3, TimeOutVal=0, pausedState=False, state="Constant output")
pline = PolyLine(Vertices=pt_8, Closed=False)  # -> flatten(Polyline)
explode = Explode(Curve=crv_2, Recursive=True)  # -> Segments, Vertices
smoothpline = SmoothPolyline(Polyline=pline, Strength=1, Times=Slider(10, range=1..10))
number_slider_3 = Slider(0.25, range=0..1)
explode_2 = Explode(Curve=smoothpline, Recursive=True)  # -> Segments, Vertices
number_slider_4 = Slider(0.329, range=0..1)
pt_9 = Point(explode_2.Vertices)
msphere_4 = MeshSphere(Base=flatten(pt_9), Radius=number_slider_4, UCount="4", VCount="4")
mpipe = MeshPipe(Curve=smoothpline, Radius=number_slider_4, Accuracy=0.2, Rotation=Slider(0, range=0..3.142), Segments="4", Caps="1")
swatch = ColourSwatch(SwatchColor=RGB(186, 50, 50))
lng_4 = ListLength(List=flatten(pt_9))
mjoin = MeshJoin(Meshes=msphere_4)
repeat = RepeatData(Data=swatch, Length=lng_4)
unim = UnifyMesh(Mesh=mjoin)  # -> Result, Count
cloud = ConstructCloud(Points=flatten(pt_9), Colors=repeat)
preview_2 = CustomPreview(Geometry=unim.Result, Material=swatch)  # disabled
