# Grasshopper definition Symmetric noise - displace.gh (Grasshopper 1.0.7)
# Copyright: Co-de-iT
# plug-ins: Weaverbird, Noise 4D

number_slider = Slider(1, range=0..2)

# ---- group: TRI-MESH
mesh = Mesh(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)

# ---- group: QUAD-MESH
mesh_2 = Mesh(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)

# ----
mirror = Mirror(Geometry=mesh, Plane=PlaneYZ(0, 0, 0))  # -> Geometry, Transform
wbjoin = WeaverbirdsJoinMeshesAndWeld(Mesh=[mirror.Geometry, mesh], Weld=False)
wbcatmullclark = WeaverbirdsCatmullClarkSubdivision(MeshCurves=mesh_2, Level=Slider(3, range=1..3), SmoothNakedEdges=number_slider)
wbcatmullclark_2 = WeaverbirdsCatmullClarkSubdivision(MeshCurves=wbcatmullclark, Level=Slider(2, range=1..3), SmoothNakedEdges=number_slider)
# Symmetric Noise on Mesh
# 
# Generates a Symmetric noise on a mesh
# 
# code by Alessio Erioli
# 
# v 0.1
wbcatmullclark_3 = WeaverbirdsCatmullClarkSubdivision(MeshCurves=wbjoin, Level=Slider(3, range=1..3), SmoothNakedEdges=Slider(2, range=0..2))
wbloop = WeaverbirdsLoopSubdivision(MeshCurves=wbcatmullclark_3, Level=Slider(3, range=1..3), SmoothNakedEdges=Slider(2, range=0..2))
list = ValueList({"TriMesh": 0, "QuadMesh": 1}, selected="QuadMesh")
filter = StreamFilter(Gate=list, Stream0=wbloop, Stream1=wbcatmullclark_2)
bbox = BoundingBox(Content=filter, Plane=PlaneXY(0, 0, 0), UnionBox=True)  # -> Box, Box_2
boxprop = BoxProperties(Box=bbox.Box)  # -> Center, Diagonal, Area, Volume, Degeneracy
xz = XZPlane(Origin=boxprop.Center)
yz = YZPlane(Origin=boxprop.Center)
filter_2 = StreamFilter(Gate=list, Stream0=yz, Stream1=xz)

# ---- group: mesh
mesh_3 = Mesh(filter)

# ---- group: symmetry plane
pln = Plane(filter_2)

# ----
demesh = DeconstructMesh(Mesh=mesh_3)  # -> Vertices, Faces, Colours, Normals
deplane = DeconstructPlane(Plane=pln)  # -> Origin, XAxis, YAxis, ZAxis

# ---- group: symmetric scalar field
plcoord = PlaneCoordinates(Point=demesh.Vertices, System=pln)  # -> XCoordinate, YCoordinate, ZCoordinate
abs = Absolute(Value=plcoord.ZCoordinate)
pt = PointOriented(BasePlane=pln, UComponent=plcoord.XCoordinate, VComponent=plcoord.YCoordinate, WComponent=abs)
perlin = PerlinNoise(Values=pt, Time=Slider(2.337, range=0..10), Scale=Slider(0.05, range=0..1))

# ----
xprod = CrossProduct(VectorA=demesh.Normals, VectorB=deplane.ZAxis, Unitize=False)  # -> Vector, Length
gradient = Gradient(LowerLimit="-1", UpperLimit=1, Parameter=perlin, stops=[0: RGB(255, 255, 255), 1: RGB(187, 0, 255)])

# ---- group: symmetric vector field / sign
c_script = CSharpScript(N=plcoord.ZCoordinate)  # -> out, S; inputs N: Double
# ---------- c_script: C# ----------
    S = (N == 0) ? 0 : (N / Math.Abs(N));
# ---------- end c_script ----------

# ---- group: symmetric vector field
num = Number(perlin)
bnd = Bounds(Numbers=flatten(num))
dom = ConstructDomain(DomainStart=0, DomainEnd=1)
pi = Pi(Factor=Slider(8, range=0..30))
remap = RemapNumbers(Value=num, Source=bnd, Target=dom)  # -> Mapped, Clipped
multiplication = Multiplication(A=remap.Mapped, B=pi)
multiplication_2 = Multiplication(A=multiplication, B=c_script.S)
vrot = Rotate(Vector=xprod.Vector, Axis=demesh.Normals, Angle=multiplication_2)

# ---- group: displacement
displacement_amount = Slider(2, range=0..10)
sin = Sine(Value=multiplication)
multiplication_3 = Multiplication(A=remap.Mapped, B=demesh.Normals, C=displacement_amount, D=sin)
move = Move(Geometry=demesh.Vertices, Motion=multiplication_3)  # -> Geometry, Transform
conmesh = ConstructMesh(Vertices=move.Geometry, Faces=demesh.Faces)

# ----
conmesh_2 = ConstructMesh(Vertices=demesh.Vertices, Faces=demesh.Faces, Colours=gradient)
vdisex = VectorDisplayEx(Point=demesh.Vertices, Vector=vrot, Colour=gradient, Width=2)
preview = CustomPreview(Geometry=conmesh, Material=ColourSwatch(SwatchColor=RGB(255, 255, 255)))
