# Grasshopper definition Symmetric noise.gh (Grasshopper 1.0.7)
# Copyright: Co-de-iT
# plug-ins: Weaverbird, Noise 4D

# ---- group: TRI-MESH
mesh = Mesh(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)

# ---- group: QUAD-MESH
mesh_2 = Mesh(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)

# ----
mirror = Mirror(Geometry=mesh, Plane=PlaneYZ(0, 0, 0))  # -> Geometry, Transform
number_slider = Slider(1, range=0..2)
wbjoin = WeaverbirdsJoinMeshesAndWeld(Mesh=[mirror.Geometry, mesh], Weld=False)
srf = Surface(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)
# Symmetric Noise on Mesh
# 
# Generates a Symmetric noise on a mesh
# 
# code by Alessio Erioli
# 
# v 0.1
wbcatmullclark = WeaverbirdsCatmullClarkSubdivision(MeshCurves=wbjoin, Level=Slider(3, range=1..3), SmoothNakedEdges=Slider(2, range=0..2))
wbcatmullclark_2 = WeaverbirdsCatmullClarkSubdivision(MeshCurves=mesh_2, Level=Slider(3, range=1..3), SmoothNakedEdges=number_slider)
mesh_uv = MeshSurface(Surface=srf, UCount=Slider(200, range=0..200), VCount=Slider(100, range=0..100), Overhang=True, Equalize=False)
wbloop = WeaverbirdsLoopSubdivision(MeshCurves=wbcatmullclark, Level=Slider(3, range=1..3), SmoothNakedEdges=Slider(2, range=0..2))
wbcatmullclark_3 = WeaverbirdsCatmullClarkSubdivision(MeshCurves=wbcatmullclark_2, Level=Slider(2, range=1..3), SmoothNakedEdges=number_slider)
list = ValueList({"TriMesh": 0, "QuadMesh": 1, "Torus": 2}, selected="QuadMesh")
filter = StreamFilter(Gate=list, Stream0=wbloop, Stream1=wbcatmullclark_3, Stream2=mesh_uv)
bbox = BoundingBox(Content=filter, Plane=PlaneXY(0, 0, 0), UnionBox=True)  # -> Box, Box_2
boxprop = BoxProperties(Box=bbox.Box)  # -> Center, Diagonal, Area, Volume, Degeneracy
demesh = DeconstructMesh(Mesh=filter)  # -> Vertices, Faces, Colours, Normals
xz = XZPlane(Origin=boxprop.Center)
yz = YZPlane(Origin=boxprop.Center)
rotate = Rotate(Geometry=xz, Angle=Slider(0, range=0..6.283), Plane=PlaneXY(0, 0, 0))  # -> Geometry, Transform
filter_2 = StreamFilter(Gate=list, Stream0=yz, Stream1=xz, Stream2=rotate.Geometry)
deplane = DeconstructPlane(Plane=filter_2)  # -> Origin, XAxis, YAxis, ZAxis
plcoord = PlaneCoordinates(Point=demesh.Vertices, System=filter_2)  # -> XCoordinate, YCoordinate, ZCoordinate
multiplier = Slider(0.416, range=0..1)
max_scale = Slider(0.08, range=0..1)
abs = Absolute(Value=plcoord.ZCoordinate)
pt = PointOriented(BasePlane=filter_2, UComponent=plcoord.XCoordinate, VComponent=plcoord.YCoordinate, WComponent=abs)
xprod = CrossProduct(VectorA=demesh.Normals, VectorB=deplane.ZAxis, Unitize=False)  # -> Vector, Length
multiplication = Multiplication(A=max_scale, B=multiplier)
perlin = PerlinNoise(Values=pt, Time=Slider(2.337, range=0..10), Scale=multiplication)
num = Number(perlin)
bnd = Bounds(Numbers=flatten(num))
dom = ConstructDomain(DomainStart=0, DomainEnd=1)
gradient = Gradient(LowerLimit="-1", UpperLimit=1, Parameter=perlin, stops=[0: RGB(255, 255, 255), 1: RGB(187, 0, 255)])
pi = Pi(Factor=Slider(8, range=0..30))
remap = RemapNumbers(Value=num, Source=bnd, Target=dom)  # -> Mapped, Clipped

# ---- group: sign
c_script = CSharpScript(N=plcoord.ZCoordinate)  # -> out, S; inputs N: list of Double
# ---------- c_script: C# usings ----------
using System.Threading;
using System.Threading.Tasks;
# ---------- c_script: C# ----------
    double[] sign = new double[N.Count];


    Parallel.For(0, N.Count, i => {
      sign[i] = (N[i] == 0) ? 0 : (N[i] / Math.Abs(N[i]));
      });
    S = sign;
# ---------- end c_script ----------

# ----
multiplication_2 = Multiplication(A=remap.Mapped, B=pi)
multiplication_3 = Multiplication(A=multiplication_2, B=c_script.S)
vrot = Rotate(Vector=xprod.Vector, Axis=demesh.Normals, Angle=multiplication_3)
conmesh = ConstructMesh(Vertices=demesh.Vertices, Faces=demesh.Faces, Colours=gradient)
vdisex = VectorDisplayEx(Point=demesh.Vertices, Vector=vrot, Colour=RGB(0, 0, 0), Width=2)
preview = CustomPreview(Geometry=conmesh, Material=ColourSwatch(SwatchColor=RGB(255, 255, 255)))
