# Grasshopper definition Util-00_Chromodoris post processing.gh (Grasshopper 1.0.7)
# Copyright: Co-de-iT
# plug-ins: Chromodoris

# Points: Input is points only. More points means slower computation.
crv = Curve([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])
divlength = DivideLength(Curve=crv, Length=Slider(1, range=0..10))  # -> flatten(Points), Tangents, Parameters
# <title>
# 
# <description>
# 
# code by Alessio Erioli
# 
# v 0.1
# Effective Range: This is the maximum search range (hence thickness) for each point. Usually approximately double the voxel size. Larger values are slower to compute.
voxelsample = SampleVoxels(
    Points=divlength.Points,
    VoxelSize=Slider(0.25, range=0..10),
    EffectiveRange=Slider(0.5, range=0..10),
    DensitySampling=False,
    LinearSampling=True)  # -> Box, VoxelData
# Sample Value: The isovalue. Changes the thickness of the produced mesh.
isosurface = BuildIsoSurface(Box=voxelsample.Box, VoxelData=voxelsample.VoxelData, SampleValue=Slider(2.45, range=0..5))
# Smoothing: A very fast but basic implementation of Laplacian smoothing. Step size is a direct smoothing multiplier, and iterations is the number of times to repeat the operation.
smooth = QuickSmooth(Mesh=isosurface, Step=0.5, Iterations=Slider(2, range=0..100))
