# Grasshopper definition Util-00_Cocoon post processing.gh (Grasshopper 1.0.7)
# Copyright: Co-de-iT
# plug-ins: MarchingCubes

number_slider = Slider(0.5, range=0..1)
crv = Curve([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])
divlength = DivideLength(Curve=crv, Length=Slider(1, range=0..10))  # -> flatten(Points), Tangents, Parameters
curve_charge = CurveCharge(Curve=crv, Radius=number_slider, ChargeStrengths="1")
# <title>
# 
# <description>
# 
# code by Alessio Erioli
# 
# v 0.1
point_charge = PointCharge(Point=divlength.Points, Radius=number_slider, ChargeStrength="1")
cocoon = Cocoon(
    Charges=curve_charge,
    Iso=Slider(0.2, range=0..1),
    CellSize=Slider(0.5, range=0..10),
    Execute=Toggle(False),
    Simple=False)  # -> Mesh, RefinementData
refine = Refine(
    RefinementData=cocoon.RefinementData,
    Samples=Slider(1, range=1..5),
    SampleSize=Slider(0.1, range=0..1),
    SampleTolerance=Slider(0.161, range=0..1),
    LaplacianSmoothing=Slider(1, range=1..5),
    ValencePasses=Slider(1, range=1..5),
    SubD=Slider(0, range=0..2),
    Execute=Toggle(False))
mesh = Mesh(refine)
