# Grasshopper definition Util-00_Dendro post processing.gh (Grasshopper 1.0.7)
# Copyright: Co-de-iT
# plug-ins: DendroGH

# ---- group: Dendro post-processing
length_threshold = Slider(0.027, range=0..1)
crv = Curve([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])
number_slider = Slider(0.08, range=0.01..1)
radius_multiplier = Slider(2.2, range=1.5..3)
divlength = DivideLength(Curve=crv, Length=Slider(0.5, range=0..1))  # -> flatten(Points), Tangents, Parameters
len = Length(Curve=crv)
multiplication = Multiplication(A=radius_multiplier, B=number_slider)
vsettings = CreateSettings(
    VoxelSize=number_slider,
    Bandwidth=Slider(0.3, range=0..3),
    Isovalue=Slider(0, range=0..1),
    Adaptivity=Slider(0, range=0..1))
larger = LargerThan(FirstNumber=len, SecondNumber=length_threshold)  # -> LargerThan, OrEqualTo
dispatch = Dispatch(List=crv, DispatchPattern=larger.LargerThan)  # -> ListA, ListB

# ----
# <title>
# 
# <description>
# 
# code by Alessio Erioli
# 
# v 0.1
pt = Point(flatten(Tree({0}: [Point(-6.715535171, -2.887072692, 160.2440852), Point(-6.680697434, -3.000603512, 160.0831595), Point(-6.64392152, -3.100270536, 159.9137074), Point(-6.606915587, -3.173776376, 159.7314234), Point(-6.573203189, -3.207361511, 159.5371671), Point(-6.54659619, -3.194429371, 159.3393671)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], {1}: [Point(-7.616866357, -0.08770801852, 161.250753), Point(-7.687583648, -0.2672309748, 161.1981168), Point(-7.740027669, -0.4509238236, 161.1389005), Point(-7.773449232, -0.6358702483, 161.0705059), Point(-7.790917508, -0.8197633837, 160.9938367), Point(-7.794292853, -1.001700856, 160.9108465)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], {2}: [Point(-7.204177997, -0.8971513564, 163.4785702), Point(-7.209467818, -1.091903221, 163.4333626), Point(-7.218006116, -1.288099688, 163.3954938), Point(-7.22979823, -1.482646343, 163.3506324), Point(-7.243765278, -1.672716699, 163.2899844), Point(-7.258402768, -1.855365652, 163.2098276)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], {3}: [Point(-5.117707383, -6.76895156, 161.749191), Point(-5.230864958, -6.66409032, 161.6219138), Point(-5.298359867, -6.583103695, 161.4519562), Point(-5.29707383, -6.552164968, 161.2543679), Point(-5.252290457, -6.581317567, 161.064516), Point(-5.187624382, -6.654464571, 160.8976409)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], {4}: [Point(-7.465029362, -0.1217741596, 160.1192014), Point(-7.496134961, -0.236548022, 159.9583928), Point(-7.512510672, -0.294388541, 159.7676408), Point(-7.532681663, -0.2644157395, 159.570931), Point(-7.561049692, -0.2110658751, 159.3802767), Point(-7.597785973, -0.06697604794, 159.2465286)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], {5}: [Point(-5.194316185, -6.782959419, 160.3047701), Point(-5.07713911, -6.888989409, 160.1841001), Point(-4.958083439, -6.989800199, 160.0610101), Point(-4.843015702, -7.083452591, 159.9299905), Point(-4.737455934, -7.168925607, 159.7864611), Point(-4.644079491, -7.237888846, 159.6271398)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]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)))
bbox = BoundingBox(Content=pt, Plane=PlaneXY(0, 0, 0), UnionBox=True)  # -> Box, Box_2
boxprop = BoxProperties(Box=bbox.Box)  # -> Center, Diagonal, Area, Volume, Degeneracy
devec = DeconstructVector(Vector=boxprop.Diagonal)  # -> XComponent, YComponent, ZComponent
merge = Merge(Data1=devec.XComponent, Data2=devec.YComponent, Data3=devec.ZComponent)
division = Division(A=merge, B=number_slider)
int = Integer(division)
panel = Panel([merge, int])

# ---- group: Dendro post-processing / compute agent bodies isomesh
vpoints = PointsToVolume(Points=pt, PointRadius=multiplication, Settings=vsettings)
vcurve = CurveToVolume(Curves=dispatch.ListA, CurveRadius=multiplication, Settings=vsettings)  # disabled
list = ValueList({"Gaussian": 0, "Laplacian": 1, "Mean": 2, "Median": 3}, selected="Median")
vsmooth = SmoothVolume(Volume=vpoints, Width=1, Type=list, Iterations=Slider(1, range=1..10))
mvolume = VolumeToMesh(Volume=vsmooth, VolumeSettings=vsettings)

# ---- group: Dendro post-processing / isomesh
mesh = Mesh(mvolume)
