# Grasshopper definition Util-03_view capture.gh (Grasshopper 1.0.7)
# Copyright: Co-de-iT

capture = BooleanToggle(False)
f_pathg = PathGenerator(subDir="Animation")  # -> dir; inputs type: Int32, subDir: String
# ---------- f_pathg: C# ----------
                           /*
    froGH - a sparse collection of (in)utilities for Grasshopper

    Path Generator
    code by Alessio Erioli - value list generation based on code by James Ramsden

    froGH by Co-de-iT is licensed under a Creative Commons Attribution 4.0 International License.
    http://creativecommons.org/licenses/by/4.0/

    */
    initComp();


    String S = "";
    String root = "";
    String end = "\\";
    String eol = Environment.NewLine;

    // __________________ autoList part __________________

    // variable for the list
    Grasshopper.Kernel.Special.GH_ValueList vList;
    // tries to cast input as list
    try{

      // if the list is not the first parameter then change Input[0] to the corresponding value
      vList = (Grasshopper.Kernel.Special.GH_ValueList) Component.Params.Input[0].Sources[0];
      // Print("value list connected");
      // check if the list must be created
      //if (vList.NickName != "dir type"){
      if (!vList.NickName.Equals("dir type")){
        vList.ClearData();
        vList.ListItems.Clear();
        vList.NickName = "dir type";
        var item1 = new Grasshopper.Kernel.Special.GH_ValueListItem("desktop", "0");
        var item2 = new Grasshopper.Kernel.Special.GH_ValueListItem("documents", "1");
        var item3 = new Grasshopper.Kernel.Special.GH_ValueListItem("GH file path", "2");
        var item4 = new Grasshopper.Kernel.Special.GH_ValueListItem("C:", "3");
        vList.ListItems.Add(item1);
        vList.ListItems.Add(item2);
        vList.ListItems.Add(item3);
        vList.ListItems.Add(item4);

        vList.ListItems[0].Value.CastTo(out type);
      }
    }
    catch{
      // handles anything that is not a value list
    }


    switch(type){
      case 0:
        root = Environment.GetFolderPath(Environment.SpecialFolder.Desktop) + end;
        S = "Desktop";
        break;
      case 1:
        root = Environment.GetFolderPath(Environment.SpecialFolder.MyDocuments) + end;
        S = "Documents";
        break;
      case 2:
        GH_Document ghDoc = owner.OnPingDocument();

        if (ghDoc.IsFilePathDefined)
        {
          int nameLen = ghDoc.DisplayName.TrimEnd('*').Length + 3; // +3 accounts for the '.gh' extension
          int fileLen = ghDoc.FilePath.TrimEnd('*').Length;

          //F = ghDoc.DisplayName.TrimEnd('*');
          root = ghDoc.FilePath.Substring(0, fileLen - nameLen);
          //root = gh_d.FilePath;
          S = "GH File path";
        }
        else
        {
          Print("No path defined. Saving to Desktop until then");
          root = Environment.GetFolderPath(Environment.SpecialFolder.Desktop);
          S = "Desktop";
        }
        break;
      case 3:
        root = "C:" + end;
        S = root + end;
        break;
    }
    dir = root + (subDir != null ? (subDir + end) : "");
    Component.Message = S;
# ---------- f_pathg: C# additional code ----------
  void initComp(){
    Component.Name = "Path Generator";
    Component.NickName = "f_PathG";
    Component.Description = "generates a path based on local direcories such as Desktop, Documents, GH file path";
    Component.Params.Input[0].Name = "dir type";
    Component.Params.Input[0].Description = "directory type: 0 desktop, 1 documents, 2 GH file path, 3 C:\nconnect a value list for automatic list generation";
    Component.Params.Input[1].Name = "custom subdir";
    Component.Params.Input[1].Description = "(optional) custom subdirectory";
  }
# ---------- end f_pathg ----------
list = ValueList({"Viewport": 0, "1920x1080": 1}, selected="1920x1080")
grid = BooleanToggle(False)
axes = BooleanToggle(False)
widget = BooleanToggle(False)
# View Capture
data = Data()
# <title>
# 
# <description>
# 
# code by Alessio Erioli
# 
# v 0.1
# To record an animation make sure this object executes last, and that the destination directory already exists.
# 
# Use a variable that updates as a trigger.
c_script = CSharpScript(
    Dir=f_pathg,
    Name="Viewport {0}.png",
    VP="Top",
    Capture=capture,
    size=list,
    grid=grid,
    axes=axes,
    widget=widget,
    Trigger=data)  # -> out, A; inputs Dir: String, Name: String, VP: String, Capture: Boolean, size: Int32, grid: Boolean, axes: Boolean, widget: Boolean
# ---------- c_script: C# usings ----------
using System.IO;
using System.Linq;
using System.Data;
using System.Drawing;
using System.Reflection;
using System.Windows.Forms;
using System.Xml;
using System.Xml.Linq;
using System.Runtime.InteropServices;

using Rhino.DocObjects;
using Rhino.Collections;
using GH_IO;
using GH_IO.Serialization;
# ---------- c_script: C# ----------
   /*
  View Capture
  Original code by David Rutten
  Minor adaptations by Alessio Erioli - Co-de-iT - 2020
  
  */
   
    if (!Capture) return;
    if (string.IsNullOrWhiteSpace(Dir)) return;
    if (string.IsNullOrWhiteSpace(Name)) return;

    // Make sure the directory ends with a \
    if (!Dir.EndsWith(System.IO.Path.DirectorySeparatorChar.ToString()))
      Dir += System.IO.Path.DirectorySeparatorChar;

    // Do not create directories, only use existing ones.
    if (!System.IO.Directory.Exists(Dir))
      return;

    // Assume index=0 for the first filename.
    string fileName = Dir + string.Format(Name, 0.ToString("D3"));

    // Try to increment the index until we find a name which doesn't exist yet.
    if (System.IO.File.Exists(fileName))
      for (int i = 1; i < int.MaxValue; i++)
      {
        string localName = Dir + string.Format(Name, i.ToString("D3"));
        if (localName == fileName)
          return;

        if (!System.IO.File.Exists(localName))
        {
          fileName = localName;
          break;
        }
      }

    Size sz = new Size(1920, 1080);

    Rhino.Display.RhinoView view = RhinoDocument.Views.Find(VP, false);
    Bitmap image;
    switch(size)
    {
      case 0:
        image = view.CaptureToBitmap(grid, widget, axes);
        break;
      case 1:
        image = view.CaptureToBitmap(sz, grid, widget, axes);
        break;
      default:
        image = view.CaptureToBitmap(grid, widget, axes);
        break;
    }
    A = image.Width;
    image.Save(fileName);
    image.Dispose();

    A = fileName;
# ---------- end c_script ----------
panel = Panel(c_script.A)
