# Grasshopper definition data tree append-insert branch.gh (Grasshopper 1.0.7)
# Copyright: Co-de-iT

# ----
# <title>
# 
# <description>
# 
# code by Alessio Erioli
# 
# v 0.1
data = Data()
data_2 = Data()
# append branch  to data tree
tstat = TreeStatistics(Tree=data)  # -> Paths, Length, Count
replace = ReplacePaths(Data=data_2, Search="{*}", Replace=tstat.Count)
merge = Merge(Data1=data, Data2=replace)

number_slider = Slider(8, range=1..18)
expression = Expression(x=number_slider, Expression="Format(\"{{<{0}}}\", x)")
pt = Point(simplify(graft(Tree({0}: [Point(3, 0, 0)], {1}: [Point(3, 0, 1)], {2}: [Point(3, 0, 2)], {3}: [Point(3, 0, 3)], {4}: [Point(3, 0, 4)], {5}: [Point(3, 0, 5)]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))))
split = SplitTree(Data=pt, Masks=flatten(expression))  # -> Positive, Negative
viewer = ParamViewer(split.Negative)
dpath = DeconstructPath(Branch=viewer)  # -> flatten(Indices)
expression_2 = Expression(x=dpath, Expression="Format(\"{{{0}}}\", x)")
addition = Addition(A=dpath, B="1")  # -> flatten(Result)
# insert branch in data tree
replace_2 = ReplacePaths(Data=split.Negative, Search=expression_2, Replace=addition)

item = ListItem(List=flatten(pt), Index=number_slider, Wrap=True)  # -> Item, Item1
avr = Average(Input=[item.Item, item.Item1])

replace_3 = ReplacePaths(Data=avr, Search="{*}", Replace=number_slider)
merge_2 = Merge(Data1=split.Positive, Data2=replace_3, Data3=replace_2)
